# Grasshopper definition IrradianceNet.gh (Grasshopper 1.0.7)
# Copyright: Job de Vogel

level_of_detail = ValueList({"1.2": 12, "1.3": 13, "2.2": 22}, selected="1.2")

# ----
# Download 3D BAG Data
size = Slider(10, range=5..11)
x = Slider(880, range=0..1000)
y = Slider(1100, range=0..1200)
load_bag = GhPythonScript(size=size, x=x, y=y, LoD=level_of_detail)  # -> out, static_context, mesh; inputs size: Int32, x: Int32, y: Int32
# ---------- load_bag: Python ----------
__author__ = "Job de Vogel"
__version__ = "2024.01.15"

import urllib
import os
import shutil
import sys
import time
from zipfile import ZipFile
import Rhino.Geometry as rg
import Grasshopper.Kernel as gh
import System
ghenv.Component.Message = 'Version 1.0\nDeveloped by Job de Vogel'

_FACE_MERGE_TOLERANCE = 0.01

run = False
if not isinstance(size, int):
    msg = "Expected 'size' input to be an integer"
elif not isinstance(x, int):
    msg = "Expected 'x' input to be an integer"
elif not isinstance(y, int):
    msg = "Expected 'y' input to be an integer"
else:
    run = True

if not run:
    w = gh.GH_RuntimeMessageLevel.Warning
    ghenv.Component.AddRuntimeMessage(w, msg)

def generate_url(id):
    items = id.split("-")

    url = 'https://data.3dbag.nl/v20240420/tiles/{}/{}/{}/{}-obj.zip'.format(items[0], items[1], items[2], id)
    
    print(url)

    return url

def validate_url(url):
    response = urllib.urlopen(url)

    if response.getcode() == 200:
        return True
    else:
        return False

def generate_id(i, x, y):
    return '{}-{}-{}'.format(i, x, y)


def download_file(id, LoD, directory):
    url = generate_url(id)
    r = urllib.urlopen(url)

    filename = '{}.zip'.format(id)

    path = os.path.join(directory, filename)

    open(path, 'wb').write(r.read())
    

    with ZipFile(path, 'r') as file: 
        file.extractall(path=path[:-4]) 

    obj_path = ''
    for file in os.listdir(path[:-4]):
        filepath = os.path.join(path[:-4], file)

        if 'LoD{}-3D.obj'.format(str(LoD)) not in filepath or '.mtl' in filepath:
            os.remove(filepath)

        else:
            obj_path = os.path.join(directory, path[:-4]) + str('.obj')
            
            try:
                shutil.move(filepath, directory)
            except shutil.Error:
                print('{} already exists, will not be overwritten'.format(obj_path))
                os.remove(filepath)

    return obj_path[:-4] + '-LoD{}-3D.obj'.format(str(LoD))

def load_obj(path):
    """Load a 3D BAG LoD 1.2 file

    Args:
        path (str): path to the .obj file

    Returns:
        mesh (rg.Mesh): mesh from the .obj file
    """
    
    # Open the file
    with open(path) as file:
        lines = file.readlines()

    # Store the vertices and faces in lists
    vertices=[]
    faces=[]
    
    # Iterate over file lines
    for line in lines:
        # Check if line is a vertex
        if line.find("v")==0 and line.find("n")==-1 and line.find("t")==-1:
            vertex = rg.Point3d(float((line.split(' '))[1]),float((line.split(' '))[2]),float((line.split(' '))[3]))
            vertices.append(vertex)
        
        # Check if line is a face
        if line.find("f")==0:
            if len(line.split(' '))==4:
                faces.append(rg.MeshFace(int(line.split(' ')[1].split('/')[0])-1,int(line.split(' ')[2].split('/')[0])-1,int(line.split(' ')[3].split('/')[0])-1))
            if len(line.split(' '))==5:
                faces.append(rg.MeshFace(int(line.split(' ')[1].split('/')[0])-1,int(line.split(' ')[2].split('/')[0])-1,int(line.split(' ')[3].split('/')[0])-1,int(line.split(' ')[4].split('/')[0])-1))
    
    # Initialize a mesh
    mesh = rg.Mesh()

    # Append the vertices and faces to the mesh
    mesh.Vertices.AddVertices(System.Array[rg.Point3d](vertices))
    mesh.Faces.AddFaces(System.Array[rg.MeshFace](faces))
    
    # Conpute the normals, make compact, merge faces
    mesh.Normals.ComputeNormals()
    mesh.Compact()
    mesh.MergeAllCoplanarFaces(_FACE_MERGE_TOLERANCE)
    
    return mesh

def get_bbox(mesh):
    """Compute the boundingbox around a mesh

    Args:
        mesh (rg.Mesh): mesh

    Returns:
        boundingbox (rg.BoundingBox): the boundingbox around the mesh
    """
    
    xy_plane = rg.Plane(rg.Point3d(0.0, 0.0, 0.0), rg.Vector3d(0.0, 0.0, 1.0))
    boundingbox = mesh.GetBoundingBox(xy_plane)
    
    return boundingbox

def translate_mesh(mesh, bbox):
    """Translate a mesh to the world origin 0,0,0

    Args:
        mesh (rg.Mesh): mesh
        bbox (rg.BoundingBox): boundingbox around the mesh

    Returns:
        mesh (rg.Mesh): translated mesh
        bbox (rg.BoundingBox): translateed boundingbox
    """
    # Compute the x and y coordinates of the original mesh center
    center = bbox.Center
    x, y = center[0], center[1]

    # Translate the mesh to the origin
    mesh.Translate(-x, -y, 0)
    
    # Translate the boundingbox to the origin
    translation = rg.Transform.Translation(-x, -y, 0)
    bbox.Transform(translation)
    
    return mesh, bbox

if run:
    id = generate_id(size, x, y)    
    file = download_file(id, LoD, 'C:\\Users\\Job de Vogel\\Desktop\\temp_files')
    
    mesh = load_obj(file)
    bbox = get_bbox(mesh)
    
    mesh, bbox = translate_mesh(mesh, bbox)
    
    static_context = file
# ---------- end load_bag ----------

mesh = Mesh(load_bag.mesh)
curve = Curve(<curve referenced from the Rhino model>)
rotation_angle = Slider(10, range=0..359)
mesh_2 = Mesh(load_bag.mesh)
port_to_exchange_data = Panel("50006")

# ----
# Server
start_server = BooleanToggle(False)
run_with_cmd_window = BooleanToggle(True)
server = GhPythonScript(port=port_to_exchange_data, run=start_server, cmd=run_with_cmd_window)  # -> out; inputs port: Int32, run: Boolean, cmd: Boolean, settings: list
# ---------- server: Python ----------
__author__ = "Job de Vogel"
__version__ = "2024.02.18"

import socket
import time

PORT = port
SHELL = not cmd

if run:
    import subprocess
    
    # This is not correct!
    python3_path = 'C:\\Users\\Job de Vogel\\.conda\\envs\\IrradianceNet310_clone\\python.exe'
    script_path = 'C:\\Users\\Job de Vogel\\OneDrive\\Documenten\\TU Delft\\Master Thesis\\Code\\IrradianceNet\\PointNeXt\\examples\\segmentation\\server.py'
    
    if settings == []:
        time_it = False
        batch_size = 1
        sub_batch_size = 1
        autocast = True
        cudnn = True
        deterministic = False
        compile = False
        synchronize = False
        overwrite_model_path = None
        
        settings = [time_it, batch_size, sub_batch_size, autocast, cudnn, deterministic, compile, synchronize, overwrite_model_path]
    
    command = [python3_path, script_path]
    additional_arguments = ["--port", str(PORT)]
    command += additional_arguments
    
    if settings[0]:
        command += ["-t", str(settings[0])]
    if settings[1]:
        command += ["-bs", str(settings[1])]
    if settings[2]:
        command += ["-sbs", str(settings[2])]
    if settings[3]:
        command += ["-a", str(settings[3])]
    if settings[4]:
        command += ["-cd", str(settings[4])]
    if settings[5]:
        command += ["-d", str(settings[5])]
    if settings[6]:
        command += ["-c", str(settings[6])]
    if settings[7]:
        command += ["-s", str(settings[7])]
    if settings[8]:
        command += ["-o", str(settings[8])] 
    
    process = subprocess.Popen(command, stdin=subprocess.PIPE, shell=SHELL)
    print('Running server with port {}...\nPlease wait a few seconds before sending data...'.format(port))
else:
    HOST = 'localhost'  # The server's hostname or IP address
    s = socket.socket(socket.AF_INET, socket.SOCK_STREAM)
    
    try:
        s.connect((HOST, PORT))
        s.sendall('exit')
        print('Closed server with port {}...'.format(port))
    except Exception:
        print('No server running!')
    finally:
        s.close()
# ---------- end server ----------
output = Panel(server)

type = ValueList({"Vertical": 0, "Horizontal": 1}, selected="Horizontal")  # disabled
solar_panel_annual_efficiency = Slider(0.2, range=0..1)  # disabled
minimum_kwh_m2 = Slider(500, range=0..1000)  # disabled
mesh_3 = Relay()
colors = Relay()

# ----
# Context Preprocessing
sample_outline_curve = Curve(curve)
translate_to_origin = BooleanToggle(False)
preprocess = Preprocess3DBAGData(static_context=load_bag.static_context, translate=translate_to_origin, outline=sample_outline_curve)  # -> out, ground, static_walls, static_roofs, static_heights, mesh, context, problem; inputs translate: Boolean, outline: Rectangle3d
# ---------- preprocess: Python ----------
"""Preprocess 3D BAG Data to ground, walls, roofs and heights
    Inputs:
        x: The x script variable
        y: The y script variable
    Output:
        a: The a output variable"""

ghenv.Component.Name = "Preprocess 3D BAG Data"
ghenv.Component.NickName = 'Preprocess'
ghenv.Component.Message = 'Version 1.0\nDeveloped by Job de Vogel'
ghenv.Component.IconDisplayMode = ghenv.Component.IconDisplayMode.application
ghenv.Component.Category = "Dataset"
ghenv.Component.SubCategory = "Preprocess Context"

__author__ = "Job de Vogel"
__version__ = "2024.01.15"

import Rhino.Geometry as rg
import Rhino
import sys
import System
import math
import random
import time
import ghpythonlib.treehelpers as th

_FACE_MERGE_TOLERANCE = 0.01
_SPLIT_TOLERANCE = 0.01
MIN_AREA = 10 # MINIMUM AREA OF A SINGLE BUILDING TO BE CONSIDERED
TRANSLATE_TO_ORIGIN = translate
FSI = True
MAX_CONTAINMENT_ITERATIONS = 50
GRID_SIZE = 1.0
SIZE = 100
OFFSET = 0.01
_REDUCE_SEGMENTS_TOLERANCE = 0.001
_MESH_SPLITTER_BBOX_HEIGHT = 2
_ANGLE_TOLERANCE_POSTP_MESH = math.pi/90
_DIAGONAL_LENGTH_RATIO_POSTP_MESH = 0.01

_MINIMUM_ANGLE = 0.017
_MINIMUM_AREA = 0.0001
_WALL_RAY_TOLERANCE = 0.1
QUAD_ONLY = False

if outline == None:
    outline = rg.Rectangle3d(rg.Plane.WorldXY, rg.Interval(-50, 50), rg.Interval(-50, 50))

''' --- LOAD --- '''
def load_obj(path):
    """Load a 3D BAG LoD 1.2 file

    Args:
        path (str): path to the .obj file

    Returns:
        mesh (rg.Mesh): mesh from the .obj file
    """
    
    # Open the file
    with open(path) as file:
        lines = file.readlines()

    # Store the vertices and faces in lists
    vertices=[]
    faces=[]
    
    # Iterate over file lines
    for line in lines:
        # Check if line is a vertex
        if line.find("v")==0 and line.find("n")==-1 and line.find("t")==-1:
            vertex = rg.Point3d(float((line.split(' '))[1]),float((line.split(' '))[2]),float((line.split(' '))[3]))
            vertices.append(vertex)
        
        # Check if line is a face
        if line.find("f")==0:
            if len(line.split(' '))==4:
                faces.append(rg.MeshFace(int(line.split(' ')[1].split('/')[0])-1,int(line.split(' ')[2].split('/')[0])-1,int(line.split(' ')[3].split('/')[0])-1))
            if len(line.split(' '))==5:
                faces.append(rg.MeshFace(int(line.split(' ')[1].split('/')[0])-1,int(line.split(' ')[2].split('/')[0])-1,int(line.split(' ')[3].split('/')[0])-1,int(line.split(' ')[4].split('/')[0])-1))
    
    # Initialize a mesh
    mesh = rg.Mesh()

    # Append the vertices and faces to the mesh
    mesh.Vertices.AddVertices(System.Array[rg.Point3d](vertices))
    mesh.Faces.AddFaces(System.Array[rg.MeshFace](faces))
    
    # Conpute the normals, make compact, merge faces
    mesh.Normals.ComputeNormals()
    mesh.Compact()
    mesh.MergeAllCoplanarFaces(_FACE_MERGE_TOLERANCE)
    
    return mesh

def translate_mesh(mesh, bbox):
    """Translate a mesh to the world origin 0,0,0

    Args:
        mesh (rg.Mesh): mesh
        bbox (rg.BoundingBox): boundingbox around the mesh

    Returns:
        mesh (rg.Mesh): translated mesh
        bbox (rg.BoundingBox): translateed boundingbox
    """
    # Compute the x and y coordinates of the original mesh center
    center = bbox.Center
    x, y = center[0], center[1]

    # Translate the mesh to the origin
    mesh.Translate(-x, -y, 0)
    
    # Translate the boundingbox to the origin
    translation = rg.Transform.Translation(-x, -y, 0)
    bbox.Transform(translation)
    
    return mesh, bbox

def get_bbox(mesh):
    """Compute the boundingbox around a mesh

    Args:
        mesh (rg.Mesh): mesh

    Returns:
        boundingbox (rg.BoundingBox): the boundingbox around the mesh
    """
    
    xy_plane = rg.Plane(rg.Point3d(0.0, 0.0, 0.0), rg.Vector3d(0.0, 0.0, 1.0))
    boundingbox = mesh.GetBoundingBox(xy_plane)
    
    return boundingbox

def partition_mesh(mesh, logger=False):
    """Partition a building mesh in floors, walls and roofs

    Args:
        mesh (rg.Mesh): building mesh

    Returns:
        valid (bool): indicates if partition succesfull
        roof_mesh (rg.Mesh): roof mesh of the building
        wall_mesh (rg.Mesh): wall mesh of the building
        floor_mesh (rg.Mesh): floor mesh of the building
    """
    
    # Transform the mesh to compact shape
    mesh.Compact()
    
    # Duplicate mesh to new roof, wall and floor mesh
    roof_mesh = mesh.Duplicate()
    roof_faces_idxs = []
    
    wall_mesh = mesh.Duplicate()
    wall_faces_idxs = []
    
    floor_mesh = mesh.Duplicate()
    floor_faces_idxs = []
    
    # Check the normal direction of the mesh faces
    for i, normal in enumerate(mesh.FaceNormals):
        # Append the face to the corresponding idx list based on normal direction
        if normal.Z > 0:
            roof_faces_idxs.append(i)
        elif normal.Z == 0:
            wall_faces_idxs.append(i)
        else:
            floor_faces_idxs.append(i)
    
    
    # Check if the floor, wall and roof has enough faces to be valid
    valid = True
    if len(wall_faces_idxs) == 0:
        valid = False
        
        return valid, roof_mesh, wall_mesh, floor_mesh
    
    valid = True
    
    # Transform indices to Sytem arrays
    roof_idxs = System.Array[System.Int32](wall_faces_idxs + floor_faces_idxs)
    wall_idxs = System.Array[System.Int32](roof_faces_idxs + floor_faces_idxs)
    floor_idxs = System.Array[System.Int32](roof_faces_idxs + wall_faces_idxs)
    
    # Delete the faces in roof, wall and floor based on index
    roof_mesh.Faces.DeleteFaces(roof_idxs)
    wall_mesh.Faces.DeleteFaces(wall_idxs)
    floor_mesh.Faces.DeleteFaces(floor_idxs)
    
    return valid, roof_mesh, wall_mesh, floor_mesh

def level_mesh(roof_mesh, wall_mesh, floor_mesh):
    """Level the mesh to height z = 0

    Args:
        roof_mesh (rg.Mesh): roof mesh of single building
        wall_mesh (rg.Mesh): wall mesh of single building
        floor_mesh (rg.Mesh): floor mesh of single building

    Returns:
        roof_mesh (rg.Mesh): leveled roof mesh of single building
        wall_mesh (rg.Mesh): leveled wall mesh of single building
        floor_mesh (rg.Mesh): leveled floor mesh of single building
    """
    
    # Get the height of the building based on the first face in the floor mesh
    try:
        height = floor_mesh.Faces.GetFaceCenter(0).Z
    except:
        height = min([vertex.Z for vertex in wall_mesh.Vertices])    
    
    # Move the meshes to the correct height
    roof_mesh.Translate(0, 0, -height)
    wall_mesh.Translate(0, 0, -height)
    floor_mesh.Translate(0, 0, -height)
    
    return roof_mesh, wall_mesh, floor_mesh

def load(path, logger=False):
    """Load a 3D BAG .obj file LoD 1.2 to Rhino roof and wall meshes

    Args:
        path (str): Path to the .obj file

    Returns:
        roof_meshes (list[rg.Mesh]): roof meshes
        wall_meshes (list[rg.Mesh]): wall meshes
        bbox (rg.BoundingBox): Boundingbox around building geometry
    """

    # Load the mesh from the .obj path
    mesh = load_obj(path)
    
    # Translate the mesh to the origin using a bounding box
    mesh, bbox = translate_mesh(mesh, get_bbox(mesh))

    # Store the roof an wall meshes in lists
    roof_meshes = []
    wall_meshes = []

    for i, mesh in enumerate(mesh.SplitDisjointPieces()):
        # Partition the mesh in roofs, walls and floors, check if splitting is valid
        valid, roof_mesh, wall_mesh, floor_mesh = partition_mesh(mesh)
        
        # Go to next iteration, skip this mesh
        if not valid:
            continue
            
        # Move the meshes to ground level z = 0
        roof_mesh, wall_mesh, floor_mesh = level_mesh(roof_mesh, wall_mesh, floor_mesh)
        
        roof_meshes.append(roof_mesh)
        wall_meshes.append(wall_mesh)

    return roof_meshes, wall_meshes, bbox

''' --- OUTLINES --- '''
def extract_building_outlines(wall_meshes, roof_meshes, tolerance=_SPLIT_TOLERANCE, logger=False):
    """Extract polyline building outlines from wall and roof meshes

    Args:
        wall_meshes (list[rg.Mesh]): list of wall meshes
        roof_meshes (list[rg.Mesh]): list of roof meshes
        tolerance (float, optional): Tolerance for adding naked edges to the outlines list. Defaults to _SPLIT_TOLERANCE.

    Returns:
        building_outlines (list[list[rg.Polyline]]): building outlines
        building_heights (list[float]): heights individual buildings
    """
    
    # Store the building outlines and heihgts
    building_outlines = []
    building_heights = []
    
    # Iterate over both walls and roofs
    for i, (wall, roof) in enumerate(zip(wall_meshes, roof_meshes)):
        # Store temporary outlines for a specific building
        outlines = []
        
        # Get the naked edges from the wall
        lines = wall.GetNakedEdges()
        
        # If the extraction succeeded
        if lines != None:       
            # Iterate over the naked lines
            for naked in lines:
                # Check the height of the naked line
                height = naked.CenterPoint().Z
                
                # If the height is lower than the tolerance, add the naked line to the outlines
                if height < tolerance:
                    outlines.append(naked)
            
            # Reduce the number of segments in the outlines
            for outline in outlines:
                outline.ReduceSegments(tolerance)
            
            # Check if the building is not floating above the ground
            if len(outlines) != 0:
                # If not, append the outlines and the building height
                building_outlines.append(outlines)
                try:
                    building_heights.append(roof.Faces.GetFaceCenter(0).Z)
                except:
                    building_heights.append(max([vertex.Z for vertex in wall.Vertices]))
            else:
                if logger:
                    print('Mesh ' + str(i) + ' does not have naked edges with height lower than tolerance ' + str(tolerance) + '. This building if floating above the ground.')
        else:
            if logger:
                print('Mesh ' + str(i) + ' naked edges extraction failed. This mesh is most likely closed.')
    
    return building_outlines, building_heights

# Find which polyline is the outer polyline of a mesh surface
def find_outer_polyline(polylines):
    """Given multiple polylines, find which polyline has the longest length, and is most likely  the outer polyline
    
    # ! IMPROVE: This assumption is theoratically not always correct

    Args:
        polylines (list[rg.Polyline]): list of polylines

    Returns:
        outer + inner (list[rg.Polyline]): ordered list of polylines
    """
    # Store the lengths of the polylines and which polylines are inner polylines
    outers = []
    inners = []
    
    curves = [polyline.ToNurbsCurve() for polyline in polylines]
    
    for inner in polylines:
        
        inside_any = False
        for outer in curves:
            is_inside = []
            for point in inner:
                
                if outer.Contains(point, rg.Plane.WorldXY) == rg.PointContainment.Inside:
                    is_inside.append(True)
                else:
                    is_inside.append(False)
         
            if all(is_inside):
                # The inner is inside this outside
                inside_any = True
                break
        if inside_any:
            inners.append(inner)
        else:
            outers.append(inner)

    return outers, inners

def includes_ground_outline(ground_outline, building_outline):
    """Check if a building outline is inside a ground outline rectangle

    Args:
        ground_outline (rg.Rectange3d): Rectangle outline for the ground patch
        building_outline (rg.Polyline): Polyline outline for a building

    Returns:
        int: -1 if outside, 1 if inside, 0 i intersecting, else None
    """
    # Boolean indicating if points are outside and inside
    outside = False
    inside = False
    
    # Base relation is unset
    relation = rg.PointContainment.Unset
    
    # Transform the ground outline polyline to Nurbscurve
    curve = ground_outline.ToNurbsCurve()
    
    # For each point in the polyline
    for point in building_outline:
        # Compute the relation with the ground outline
        relation = curve.Contains(point)
        
        # Set the relations
        if relation == rg.PointContainment.Inside:
            inside = True
        elif relation == rg.PointContainment.Outside:
            outside = True
        
        if outside and inside:
            return 0
    
    # If not intersecting, check the new relation
    if outside and not inside:
        return -1
    elif inside and not outside:
        return 1
    else:
        return None

def find_segments(segments, base_curve):
    """Find which segments from a segmented curve should be kept and which
    should be deleted.
    Inputs:
        segments: The segments as polylines
        base_curve: The curve used for containment
    Output:
        polylines: the segments that should be kept"""
    
    #Store the polylines that should be kept    
    polylines = []
    for segment in segments:
        #Transform the segment from rg.Polyline to rg.NurbsCurve
        segment = segment.ToNurbsCurve()
        
        #Get 
        domain = segment.Domain
        midpoint_parameter = domain.Mid
        
        midpoint = segment.PointAt(midpoint_parameter)
        
        if base_curve.Contains(midpoint, rg.Plane.WorldXY) == rg.PointContainment.Inside:
            polylines.append(segment)
        elif base_curve.Contains(midpoint, rg.Plane.WorldXY) == rg.PointContainment.Coincident:
            polylines.append(segment)

    return polylines
    
def cut_polyline(ground_outline, building_outline, tolerance=_SPLIT_TOLERANCE, min_area=MIN_AREA, logger=False):
    # Transform polylines to curves
    ground_curve = ground_outline.ToNurbsCurve()
    building_curve = building_outline.ToNurbsCurve()
    
    # Compute intersection between building and ground outline curve
    intersection_events = rg.Intersect.Intersection.CurveCurve(building_curve, ground_curve, tolerance, tolerance)
    
    # Store the parameter lengths for building and ground curve
    parameters_ground = []
    parameters_building = []
    for event in intersection_events:
        if event.IsPoint:
            
            # Compute the points for the building intersection
            parameter_building = building_curve.ClosestPoint(event.PointA)[1]
            parameters_building.append(parameter_building)

            # Compute the points for the ground intersection
            parameter_ground = ground_curve.ClosestPoint(event.PointB)[1]
            parameters_ground.append(parameter_ground)
    
    parameters_building = System.Array[System.Double](parameters_building)
    parameters_ground = System.Array[System.Double](parameters_ground)
    
    # Compute the segments for the ground and building outlines
    ground_segments = ground_curve.Split(parameters_ground)
    building_segments = building_curve.Split(parameters_building)
    
    # Get the inner building segment
    building_segments = find_segments(building_segments, ground_curve)

    # Get the ground segment
    ground_polylines = [segment.TryGetPolyline()[1] for segment in ground_segments]
    ground_segments = find_segments(ground_polylines, building_curve)

    new_building_curves = System.Array[rg.NurbsCurve](building_segments + ground_segments)
    joined_building_curve = rg.Curve.JoinCurves(new_building_curves, tolerance)
    
    projections = [rg.Curve.ProjectToPlane(curve, rg.Plane.WorldXY) for curve in joined_building_curve]
    polylines = [curve.TryGetPolyline()[1] for curve in projections]
    
    if len(polylines) == 0:
        if logger:
            print("cut_polyline() was not able to extract polylines")
    
    valid_polylines = []
    for polyline in polylines:
        template = polyline.Duplicate()
        
        try:
            if polyline.IsClosed:
                area = rg.AreaMassProperties.Compute(template.ToNurbsCurve()).Area       
            
                if area > min_area:
                    valid_polylines.append(polyline)
            else:
                points = [point for point in polyline]
                points += [points[0]]
                template = rg.Polyline(System.Array[rg.Point3d](points))
                
                area = rg.AreaMassProperties.Compute(template.ToNurbsCurve()).Area  
                
                if area > min_area:
                    valid_polylines.append(polyline)
        except AttributeError:
            # Area computation returns None
            valid_polylines.append(polyline)
                
    return valid_polylines

def fix_self_intersections(polyline):
    curve = polyline.ToPolylineCurve()
    intersections = rg.Intersect.Intersection.CurveSelf(curve, 0.001)
    
    if intersections > 0:
        intersect = True
    else:
        intersect = False
    
    parameters = []
    for event in intersections:
        event_parameters = System.Array[float]([event.ParameterA, event.ParameterB])
        
        parameters += event_parameters
    
    curve_segments = curve.Split(parameters)
    
    polyline_segments = []
    polyline_lengths = []
    for curve in curve_segments:
        polyline = curve.TryGetPolyline()[1]
        polyline_segments.append(polyline)
        polyline_lengths.append(polyline.Length)
    
    polylines_sorted = [pl for _, pl  in sorted(zip(polyline_lengths, polyline_segments))]
    
    if len(intersections) == 0:
        polyline = polyline
    if len(intersections) == 1:
        polyline = polylines_sorted[-1]
        
        # CHECK IF CLOSED!!!
    elif len(intersections) > 1:
        polylines_sorted_inv = polylines_sorted[::-1]
        
        curves = System.Array[rg.Curve](
            [polylines_sorted_inv[i].ToNurbsCurve() for i in range(0, len(intersections))]
            )
        
        polyline = rg.NurbsCurve.JoinCurves(curves)[0].TryGetPolyline()[1]
    
    return polyline, intersect

# Translate objects to origin
def translate(outline, ground_outline, height=0):
    # Compute center of bbox
    center = ground_outline.Center
    x, y = center.X, center.Y
    translation = rg.Transform.Translation(-x, -y, height)
    outline.Transform(translation)

def compute_FSI(ground_outline, building_outlines, logger=False):
    ground_area = rg.AreaMassProperties.Compute(ground_outline.ToNurbsCurve()).Area
    
    building_areas = []
    for outlines in building_outlines:
        if len(outlines) > 0:
            try:            
                building_areas.append(
                    rg.AreaMassProperties.Compute(outlines[0].ToNurbsCurve()).Area
                    )
            except:
                if logger:
                    print("RESOLVE: Polyline was not closed so area not added to FSI")
    
    return sum(building_areas) / ground_area, ground_area, building_areas

def generate_building_outlines(ground_outline, all_building_outlines, heights, translate_to_origin=TRANSLATE_TO_ORIGIN, fsi=FSI, logger=False):    
    """Compute the building outlines that are inside a ground outline. If a building polyline intersects
    with the ground outline, the building outlines are splitted in multiple segmenets and then closed.

    Args:
        ground_outline (rg.Rectangle3d): ground rectangle outline
        all_building_outlines (list[list[rg,Polyline]]): all building outlines
        heights (listt[float]): all heights of the buildings
        translate_to_origin (bool, optional): indicates if outlines should be moved to origin. Defaults to TRANSLATE_TO_ORIGIN.
        fsi (bool, optional): Indicates if fsi should be computed. Defaults to FSI.

    Returns:
        building_outlines (list[list[rg.Polyline]]): outlines for the buildings (including splitted intersecting building outlines)
        courtyard_outlines (list[list[rg.Polyline]]): outlines for the courtyards, empty if no courtyard available
        building_heights (list[float]): heights of the included buildings
        FSI_score (float): fsi score, None if not computed
        envelope_area (float): area of envelope in m2, None if not computed 
        building_area (float): area of all building, courtyards included in m2, None if not computed
    """
    
    # Store the polylines and heights
    included_polylines = []
    courtyards = []
    building_heights = []
    num_of_courtyards = 0
    
    idxs = []
    
    # Iterate over all outlines and the corresponding heights
    for i, (polylines, height) in enumerate(zip(all_building_outlines, heights)):
        # The outer polyline of the building
        outer = polylines[0]
        
        # There is only one polyline, so there is no courtyard
        if len(polylines) == 1:
            # Check if outer polyline inside the ground_outline
            relation = includes_ground_outline(ground_outline, outer)
            
            # This building is inside the ground outline
            if relation == 1:
                included_polylines.append([outer])
                building_heights.append(height)
                
                # No courtyards are available, so add empty list
                courtyards.append([])
                idxs.append(i)
            
            # This building is intersecting with the ground outline
            elif relation == 0:
                # Cut the polyline and add it to included_polylines
                polylines = cut_polyline(ground_outline, outer)
                               
                if len(polylines) > 0:                   
                    # if smallest_area > min_area:
                    included_polylines.append(polylines)
                    building_heights.append(height)
            
                    # No courtyards are available, so add empty list
                    courtyards.append([])
                
#                idxs.append(i)
        # There are polylines, so there is at least one courtyard
        else:
            # First find the courtyards
            temp_courtyard_polylines = []
            
            # Check if the courtyard outlines are inside the ground outline
            for inner in polylines[1:]:
                # These are the couryards!
                relation = includes_ground_outline(ground_outline, inner)
                
                # Courtyards do NOT have to agree with minimum area
                if relation == 1:
                    temp_courtyard_polylines.append(inner)
                    num_of_courtyards += 1
                    
            # Check if the outer polyline is inside the groundline
            relation = includes_ground_outline(ground_outline, outer)
            
            # The outer polyline is inside the ground polyline
            if relation == 1:
                included_polylines.append([outer])
                building_heights.append(height)
                
                # Outer was inside ground_outline, so all courtyards too
                courtyards.append(temp_courtyard_polylines)
            
            # The outer polyline intersects the ground polyline
            elif relation == 0:
                polylines = cut_polyline(ground_outline, outer)
                included_polylines.append(polylines)
                
                building_heights.append(height)
                
                # Check if any courtyard_outlines are inside the ground outline
                if len(temp_courtyard_polylines) > 0:
                    courtyards.append(temp_courtyard_polylines)
                else:
                    # Add an empty list
                    courtyards.append([])

    # Translate all outlines to the origin
    if translate_to_origin:
        for outlines in included_polylines:
            for polyline in outlines:
                translate(polyline, ground_outline)
        
        for outlines in courtyards:
            for outline in outlines:
                translate(outline, ground_outline)        
        
        # Translate the ground outline to the origin    
        translate(ground_outline, ground_outline)
    
    if fsi:
        FSI_score, envelope_area, building_area = compute_FSI(ground_outline, included_polylines)
    else:
        FSI_score = None
        envelope_area = None
        building_area = None

    building_outlines = included_polylines
    courtyard_outlines = courtyards

    return building_outlines, courtyard_outlines, building_heights, FSI_score, envelope_area, building_area, idxs

# --- SERIALIZATION ---
#def serialize(data):
#    """Serialize polyline data assuming the structure [[rg.Polyline], [...]]
#    Serializing can be used to make sure data is not changed in-place
#
#    Args:
#        data (list[list[rg.Polyline]]): polylines to serialize
#
#    Returns:
#        json string (str): serialized polylines in JSON format 
#    """
#    
#    # Iterate over all polylines in the data
#    for i, outlines in enumerate(data):
#        for j, polyline in enumerate(outlines):
#            # Transform the polyline data too points
#            data[i][j] = polyline_to_points(polyline)
#    
#    return json.dumps(data)
#
#def deserialize(data):
#    """Deserialize polyline data assuming the structure [[rg.Polyline], [...]]
#
#    Args:
#        data (JSON str): JSON string containing polyline data
#
#    Returns:
#        data (list[list[rg.Polyline]]): polylines to serializee
#    """
#    
#    # Load the JSON data
#    data = json.loads(data)
#    for i, outlines in enumerate(data):
#        for j, polyline in enumerate(outlines):
#            # Extract the points for the outline
#            points = [rg.Point3d(point[0],point[1],point[2]) for point in polyline]
#            
#            # Transform the points to an outline
#            data[i][j] = points_to_polyline(points)
#
#    return data

' --- MESHING --- '
def postprocess_mesh(mesh, check=False):
    """Postprocess a mesh such that there are no invalid faces or vertices

    Args:
        mesh (rg.Mesh): mesh
        check (bool, optional): Check if the mesh is valid. Defaults to False.

    Returns:
        mesh (rg.Mesh): postprocessd mesh
    """
    
    # Convert triangle faces to quad
    mesh.Faces.ConvertTrianglesToQuads(_ANGLE_TOLERANCE_POSTP_MESH, _DIAGONAL_LENGTH_RATIO_POSTP_MESH)
    
    # Get vertices and faces    
    vertices = mesh.Vertices
    faces = mesh.Faces
    
    # Initialize a rebuild mesh
    rebuild_mesh = rg.Mesh()

    # Add the mesh vertices and faces to the rebuild mesh
    rebuild_mesh.Vertices.AddVertices(vertices)
    rebuild_mesh.Faces.AddFaces(faces)
    
    # Check if the mesh is valid
    if check:
        print('Adding vertices and faces: {}'.format(rebuild_mesh.IsValidWithLog()))
    
    # Compute the normals
    rebuild_mesh.Normals.ComputeNormals()
    
    # Check if the mesh is valid
    if check:
        print('Computing normals: {}'.format(rebuild_mesh.IsValidWithLog()))
    
    # Transform the mesh to a compact shape
    rebuild_mesh.Compact()
    
    # Check if the mesh is valid
    if check:
        print('Compact: {rebuild_mesh.IsValidWithLog()}'.format(rebuild_mesh.IsValidWithLog()))
        
    # Cull degenerate faces
    rebuild_mesh.Faces.CullDegenerateFaces()
    
    # Check if the mesh is valid
    if check:
        print('Cull degenerate faces: {}'.format(rebuild_mesh.IsValidWithLog()))
    
    # Delete zero area mesh faces
    indices =  rebuild_mesh.Faces.GetZeroAreaFaces()[1]
    rebuild_mesh.Faces.DeleteFaces(indices, True)
    
    indices =  rebuild_mesh.Faces.GetZeroAreaFaces()[2]
    rebuild_mesh.Faces.DeleteFaces(indices, True)
        
    return rebuild_mesh

def get_random_face_center(mesh):
    """Extract a random face center from a mesh

    Args:
        mesh (rg.Mesh): mesh

    Returns:
        checkpoint (rg.Point3d): random face center
    """
    
    # Random index
    idx = random.randint(0, len(mesh.Faces))
    
    # Get the vertices from the face
    vertices = mesh.Faces.GetFaceVertices(idx)[1:]
    
    # Compute the center of the face
    center_x = sum(p.X for p in vertices) / len(vertices)
    center_y = sum(p.Y for p in vertices) / len(vertices)
    center_z = sum(p.Z for p in vertices) / len(vertices)

    # Generate a point
    checkpoint = rg.Point3d(center_x, center_y, center_z)   
    
    return checkpoint
    
def is_inside(mesh, curves, max_iterations=MAX_CONTAINMENT_ITERATIONS, logger=False, std=False):
    """Check if a planar mesh is inside any curve in a set of curves. This procedure works by taking a
    mesh face center and then checking if this center is inside the curve. In some special
    cases, this point intersects with the curve. In that case the multiple random faces centers
    are taken until a point does not intersect, or the max containment iterations is reached.
    If it still intersects, it is assumed that the mesh is inside the curve.

    Args:
        mesh (rg.Mesh): planar mesh
        curves (list(rg.NurbsCurve)): list of planar curves
        max_iterations (int, optional): Number of maximum containment iterations. Defaults to MAX_CONTAINMENT_ITERATIONS.

    Returns:
        inside (bool): indicates if inside one of the cuves
    """
      
    # Generate an intial checkpoint
    checkpoint = get_random_face_center(mesh)
        
    # Bool indicating if mesh is inside the curve
    inside = False
    
    # Find a quad mesh and get the face center
    checkpoint = None
    for i, face in enumerate(mesh.Faces):
        if face.IsQuad:
            checkpoint = mesh.Faces.GetFaceCenter(i)
            break
    
    # The mesh does not have quad faces (outlier situation)
    if not isinstance(checkpoint, rg.Point3d):
        # Generate an intial checkpoint
        checkpoint = get_random_face_center(mesh) 
    
    # Iterate over the curves
    for curve in curves:
        # Iterate over the max iterations
        for i in range(max_iterations):
            # Check if the curve contains the checkpoint
            
            if curve.Contains(checkpoint, rg.Plane.WorldXY, tolerance=1e-8) == rg.PointContainment.Inside:
                inside = True
                break
            elif curve.Contains(checkpoint, rg.Plane.WorldXY, tolerance=1e-8) == rg.PointContainment.Coincident:
                inside = True
            
                # Generate a new checkpoint
                checkpoint = get_random_face_center(mesh)
                    
                if i == max_iterations - 1:
                    if logger:
                        print('Point containment coincident')
                break
    if std:
        print((checkpoint.X, checkpoint.Y, checkpoint.Z))

    return inside

def project_outlines_to_world_xy(outlines):
    """Project polylines to the world XY plane, returns both a polyline and curves format

    Args:
        outlines (list[list[rg.Polyline]]): building outulines as polylines
        
    Returns:
        polylines (list[list[rg.Polyline]]): projected polylines
        curves (list[rg.NurbsCurve]): projected curves    
    """
    
    # Store the projected polylines and curves as lists
    polylines = []
    curves = []
    
    # Project the building outlines on the mesh plane
    for outline_set in outlines:
        # Store projections per building
        temp_polylines = []
        temp_curves = []
        
        # Iterate over the polylines used in the building outlines
        for polyline in outline_set:
            # Reduce the number of segments in the polyline
            polyline.ReduceSegments(_REDUCE_SEGMENTS_TOLERANCE)
            
            # Convert a duplicate polyline to a nurbscurve
            curve = polyline.Duplicate().ToNurbsCurve()
            
            # Project the curve on the mesh plane
            projected_curve = curve.ProjectToPlane(curve, rg.Plane.WorldXY)
            
            # Generate a polyline from the curve
            projected_polyline = projected_curve.TryGetPolyline()[1]
            
            # Append the building polylines and curves to all polylines and curves
            temp_polylines.append(projected_polyline)
            temp_curves.append(projected_curve)
        
        polylines.append(temp_polylines)
        curves.append(temp_curves)    
        
    return polylines, curves

def compute_area(ground, roofs):
    ground_area = rg.AreaMassProperties.Compute(ground).Area
    building_area = sum([rg.AreaMassProperties.Compute(building).Area for building in roofs])
    
    return ground_area, building_area

def remesh_rough(mesh):
    rough_mesh = mesh.Duplicate()
    
    rough_mesh.Reduce(100, False, 3, False, False)

    return rough_mesh

def polyline_isclockwise(polyline):
    """Check if the vertices of a polyline are clockwise

    Args:
        polyline (rg.Polyline): polyline

    Returns:
        bool: True if clockwise
    """
    
    # Connvert to duplicate nurbscurve to avoid in-place changes
    curve = polyline.Duplicate().ToNurbsCurve()
    return curve.ClosedCurveOrientation() == rg.CurveOrientation.Clockwise

def mesh_extrude_polyline(polyline, height, grid_size):
    """Extrude a polyline to a mesh

    Args:
        polyline (rg.Polyline): polyline
        height (float): height of the building
        grid_size (float): approximate size of the mesh faces

    Returns:
        meshh (rg.Mesh): wall mesh
    """
    vertices = []
    faces = []
    
    # Reduce the number of segments to a minimum
    polyline.ReduceSegments(_REDUCE_SEGMENTS_TOLERANCE)
    
    # Extract the segments to a list
    segments = polyline.GetSegments()
    
    # Get the lengths of each segment
    lengths = [segment.Length for segment in segments]
    
    # Compute how many faces each segment should have in horizonal direction
    num_segments = [int(math.ceil(length / grid_size)) for length in lengths]
    
    # Compute how many faces each segment should have in vertical directioin
    levels = int(math.ceil(height / grid_size))
    
    # Total number of faces in horizontal directtion
    num_p = sum(num_segments)
    
    # Vertices on the ground level
    base_vertices = []
    
    # Vertices all together
    vertices = []
    
    # Iterate over the segments
    for segment, num_segment in zip(segments, num_segments):
        
        # Iterate over the number of segments
        for i in range(num_segment):
            parameter = i * (1 / num_segment)
            
            # Add the vertex to the base vertices
            base_vertices.append(segment.PointAt(parameter))
    
    # Iterate over the vertical levels
    for j in range(levels + 1):
        parameter = j * (height / levels)
        
        # Iterate over the base vertices
        for vertex in base_vertices:
            # Add a base vertex at each level
            vertices.append(rg.Point3d(vertex.X, vertex.Y, vertex.Z + parameter))
    
    # Generate the mesh faces
    faces = System.Array[rg.MeshFace]([
        rg.MeshFace(i + j * num_p, i + (j + 1) * num_p, (i + 1) % num_p + (j + 1) * num_p, (i + 1) % num_p + j * num_p)
        for j in range(levels)
        for i in range(num_p)
    ])
    
    # Initialize a new mesh
    mesh = rg.Mesh()
    
    # Add the vertices and faces to the mesh
    mesh.Vertices.AddVertices(System.Array[rg.Point3d](vertices))
    mesh.Faces.AddFaces(faces)
    
    return mesh

def generate_vertical(building_outlines, courtyard_outlines, heights, grid_size):
    """_summary_

    Args:
        building_outlines (list[list[rg.Polyline]]): List of building outlines
        courtyard_outlines (list[list[rg.Polyline]]): Inner courtyard polylines of the buildings
        heights (list[float]): heigths of the buildings
        grid_size (float): grid size

    Returns:
        meshes (list[rg.Mesh]): walls for the buildings based on the outlines
        outlines (list[rg.Polyline]): outlines of the buildings, possibly reversed direction
    """
    
    # Store the outputs in lists
    meshes = []

    # Iterate over the buildings
    for building, courtyard, height in zip(building_outlines, courtyard_outlines, heights):
        # Store courtyard and building walls in one temp mesh
        temp_mesh = rg.Mesh()
        
        # Reverse direction of outlines if necessary
        for outline in building:
            # Reverse direction if necessary
            if not polyline_isclockwise(outline):
                outline.Reverse()
            
            # Extrude the polyline in z direction based on height
            mesh = mesh_extrude_polyline(outline, height, grid_size)
            
            # Append the results to list variables
            temp_mesh.Append(mesh)
        
        # Iterate over courtyards
        for outline in courtyard:
            # Reverse directtion if necessary
            if polyline_isclockwise(outline):
                outline.Reverse()
            
            # Appeend the results to list variables
            mesh = mesh_extrude_polyline(outline, height, grid_size)
            temp_mesh.Append(mesh)
        
        # Append the building walls processed, as a single mesh        
        meshes.append(postprocess_mesh(temp_mesh))

    return meshes

def _generate_vertical(polylines, heights, grid_size, logger=False):
    """_summary_

    Args:
        building_outlines (list[list[rg.Polyline]]): List of building outlines
        courtyard_outlines (list[list[rg.Polyline]]): Inner courtyard polylines of the buildings
        heights (list[float]): heigths of the buildings
        grid_size (float): grid size

    Returns:
        meshes (list[rg.Mesh]): walls for the buildings based on the outlines
        outlines (list[rg.Polyline]): outlines of the buildings, possibly reversed direction
    """
    
    # Store the outputs in lists
    meshes = []

    for polyline, height in zip(polylines, heights):
        temp_mesh = rg.Mesh()
        
        # Reverse direction if necessary
        if not polyline_isclockwise(polyline):
            polyline.Reverse()
        
        # Extrude the polyline in z direction based on height
        mesh = mesh_extrude_polyline(polyline, height, grid_size)
        
        meshes.append(postprocess_mesh(mesh))

    return meshes

def extrude(polyline):
    lower_polyline = rg.Polyline(
        [p + rg.Vector3d(0,0,-1) for p in polyline]
    )
    
    mesh = rg.Mesh()
    for pt in lower_polyline:
        mesh.Vertices.Add(pt)
        mesh.Vertices.Add(pt + rg.Vector3d(0,0,2))
    
    for i in range(len(polyline) - 1):
        mesh.Faces.AddFace(i * 2, i * 2 + 1, (i + 1) * 2 + 1, (i + 1) * 2)
    
    mesh.Vertices.CullUnused()
    mesh.Vertices.CombineIdentical(True, True)
    mesh.RebuildNormals()
    
    return mesh

def _check_invalid_splitters(splitters, meshes, polylines, outline):
    invalid_splitters = []
    valid_splitters = []
    invalid = []
    valid = []
    
    # Splitter check
    if len(splitters) != len(meshes) - 1:
        for i, line in enumerate(polylines):
            close = False
            for m in meshes[1:]:
                # Make an exception for intersecting polylines with outer outline
                
                distances = []
                for point in line:
                
                    if outline.ToNurbsCurve().Contains(point, rg.Plane.WorldXY) == rg.PointContainment.Inside:
                        distance = rg.Line(m.ClosestPoint(point), point).Length
                        distances.append(distance)
                    
                    else:
                        # Point is outside boundary
                        pass
                    
                if all([distance < 0.001 for distance in distances]):
                    close = True
                    valid_splitters.append(splitters[i])
                    valid.append(line)
                    break
            
            if not close:
                invalid_splitters.append(splitters[i])
                invalid.append(line)
    print(len(valid_splitters))
    print(len(invalid_splitters))
    return invalid_splitters, valid_splitters, invalid, valid
    

def _backward_mesh_to_polyline(meshes, polylines):
    polyline_indices = []
    
    for mesh in meshes:  
        for i, polyline in enumerate(polylines):
            distances = []
            
            for point in polyline:
                distance = rg.Line(mesh.ClosestPoint(point), point).Length
                distances.append(distance)
                
                if distance > 0.001:
                    break
            
            if all([distance < 0.001 for distance in distances]):
                polyline_indices.append(i)
                break

    return polyline_indices

def check_invalid_area():
    pass

def _generate_horizontal(ground_outline, building_polylines, courtyard_polylines, heights, grid_size, size, logger=False):
    """Generate ground and roofs by splitting a mesh plane

    Args:
        ground_outline (rg.Rectangle3d): ground patch outline
        building_outlines (list[list[rg.Polyline]]): outlines for buildings
        courtyard_outlines (list[list[rg.Polyline]]): outlines for courtyards
        heights (list[float]): building heights
        grid_size (float): grid size

    Returns:
        ground (rg.Mesh): 2D mesh for ground
        roofs (list[rg.Mesh]): roof meshes
        valid (list[bool]): indicates if a roof mesh is valid
    """
    # Generate plane parameters
    box_interval = rg.Box(ground_outline.BoundingBox)
    plane_width = rg.Interval(box_interval.X[0], box_interval.X[1])
    plane_height = rg.Interval(box_interval.Y[0], box_interval.Y[1])
    plane = rg.Plane.WorldXY

    # Compute the number of face divisions for the mesh plane    
    width_divisions = System.Int32(int(plane_width.Length / grid_size))
    length_divisions = System.Int32(int(plane_height.Length / grid_size))
    
    # Generate the mesh plane
    ground_mesh = rg.Mesh.CreateFromPlane(plane, plane_width, plane_height, width_divisions, length_divisions)   
    
    all_polylines = []
    all_heights = []
    
    for i, (polyline_set, height) in enumerate(zip(building_polylines, heights)):
        for polyline in polyline_set:
            if polyline != None:
                all_polylines.append(polyline)
                all_heights.append(height)
    
    for j, (polyline_set, heights) in enumerate(zip(courtyard_polylines, heights)):
        for polyline in polyline_set:
            if polyline != None:
                all_polylines.append(polyline)
                all_heights.append(height)
    
    splitters = [extrude(pl) for pl in all_polylines]

    log = Rhino.FileIO.TextLog()
    token = System.Threading.CancellationToken()
    
    # Initial split
    meshes = ground_mesh.Split(
        System.Array[rg.Mesh](splitters),
        10e-8,
        True,
        True,
        log,
        token,
        None
        )
        
    
    invalid_splitters = []
    valid_splitters = []
    invalid = []
    valid = []
    
    for i, line in enumerate(all_polylines):
        close = False
        
        for m in meshes[1:]:
            distances = []
            for point in line:
                if outline.ToNurbsCurve().Contains(point, rg.Plane.WorldXY) == rg.PointContainment.Inside:
                    distance = rg.Line(m.ClosestPoint(point), point).Length
                    distances.append(distance)
                
                else:
                    # Point is outside boundary
                    pass
                
            if all([distance < 0.001 for distance in distances]):
                close = True
                valid_splitters.append(splitters[i])
                valid.append(line)
                break
            
            if close:
                break
        
        if not close:
            invalid_splitters.append(splitters[i])
            invalid.append(line)
    
    if len(invalid_splitters) > 0:
        # DO EXTRUSION AGAIN WITH VALID POLYLINES
        meshes = ground_mesh.Split(
            System.Array[rg.Mesh](valid_splitters),
            10e-8,
            True,
            True,
            log,
            token,
            None
            )
    
    if len(valid) > 0:
        polylines = valid
    
    ground_mesh = meshes[0]
    
    # Backtrack if mesh is building or courtyard
    building_meshes = []
    courtyard_meshes = []
    
    for i, mesh in enumerate(meshes[1:]):
        
        building = False
        for naked_outline in mesh.GetNakedEdges():
            distances = []
            
            for point in naked_outline:
                if outline.ToNurbsCurve().Contains(point, rg.Plane.WorldXY) == rg.PointContainment.Inside:
                    distance = rg.Line(ground_mesh.ClosestPoint(point), point).Length
                    distances.append(distance)
                else:
                    # Point is outside boundary
                    pass
            
            if any([distance < 0.00001 for distance in distances]):
                # This outline is connected to the ground mesh, so it is a building roof
                building_meshes.append(mesh)
                building = True
                break  
            
        if not building:
            courtyard_meshes.append(mesh)
            
    building_indices = _backward_mesh_to_polyline(building_meshes, all_polylines)
    courtyard_indices = _backward_mesh_to_polyline(courtyard_meshes, all_polylines)
   
    building_heights = [all_heights[idx] for idx in building_indices]
    courtyard_heights = [all_heights[idx] for idx in courtyard_indices]
    
    all_heights = building_heights + courtyard_heights

    # Iterate over the roof meshes to translate to the correct height
    for i, (mesh, height) in enumerate(zip(building_meshes, building_heights)):       
        # Create a transform based on the height
        transform = rg.Transform.Translation(System.Double(0.0),System.Double(0.0),System.Double(height))
        
        # Move the mesh
        mesh.Transform(transform)

    for mesh in courtyard_meshes:
        ground_mesh.Append(mesh)

    building_polylines = [all_polylines[idx] for idx in building_indices]  
    courtyard_polylines = [all_polylines[idx] for idx in courtyard_indices]

    # all heights: list of all building heights followed by all courtyard heights
    return ground_mesh, building_meshes, building_polylines, courtyard_polylines, all_heights

def generate_horizontal(ground_outline, building_polylines, courtyard_polylines, building_curves, courtyard_curves, heights, grid_size, size, logger=False):
    """Generate ground and roofs by splitting a mesh plane

    Args:
        ground_outline (rg.Rectangle3d): ground patch outline
        building_outlines (list[list[rg.NurbsCurve]]): outlines for buildings
        courtyard_outlines (list[list[rg.NurbsCurve]]): outlines for courtyards
        heights (list[float]): building heights
        grid_size (float): grid size

    Returns:
        ground (rg.Mesh): 2D mesh for ground
        roofs (list[rg.Mesh]): roof meshes
        valid (list[bool]): indicates if a roof mesh is valid
    """
    print(type(ground_outline))
    # Generate plane parameters
    box_interval = rg.Box(ground_outline.BoundingBox)
    plane_width = rg.Interval(box_interval.X[0], box_interval.X[1])
    plane_height = rg.Interval(box_interval.Y[0], box_interval.Y[1])
    plane = rg.Plane.WorldXY

    # Compute the number of face divisions for the mesh plane    
    width_divisions = System.Int32(int(plane_width.Length / grid_size))
    length_divisions = System.Int32(int(plane_height.Length / grid_size))
    
    # Generate the mesh plane
    mesh_plane = rg.Mesh.CreateFromPlane(plane, plane_width, plane_height, width_divisions, length_divisions)   
    
    # Generate the splitters from the inner and outer polylines
    params = rg.MeshingParameters.QualityRenderMesh
    bbox = rg.BoundingBox(0,0,-_MESH_SPLITTER_BBOX_HEIGHT,size,size,_MESH_SPLITTER_BBOX_HEIGHT)
    
    # Store the splitters in a list
    splitters = []
    valid = []
    
    # Iterate over the buildings
    for outline_set in building_curves:
        # Store the splitters per building
        temp_splitters = []
        
        # Iterate over the outlines
        for curve in outline_set:
            # Create a duplicate curve
            temp_curve = curve.Duplicate()
            
            # Translate the curve to z = -1
            temp_curve.Translate(0,0,-1)
            
            # Generate a mesh splitter (extra unit on -z side)
            splitter = rg.Mesh.CreateFromCurveExtrusion(temp_curve, rg.Vector3d(0,0,1), params, bbox)
            
            # Add the splitter to all splitters for this specific building
            temp_splitters.append(splitter)
        
        # Add the building splitters to all building splitters
        splitters.append(temp_splitters)
    
    # Store the splitters in a list
    roofs = []

    # Iterate over the splitters and buildings
    for sample, (splitter_set, building_curve_set, courtyard_curve_set) in enumerate(zip(splitters, building_curves, courtyard_curves)):
        
        # Store the roof meshes for a single building in a temp mesh
        temp_roofs = rg.Mesh()
        
        # Iterate over the building outlines
        for splitter, building_curve in zip(splitter_set, building_curve_set):
            success = False
            
            # Split the mesh
            # ----- WARNING: VERY TIME CONSUMING! -----
            elements = mesh_plane.Split(splitter)
            
            # Postprocess the mesh elements
            elements = [postprocess_mesh(element) for element in elements]
            
            # If more than one splitting elements returned
            if len(elements) > 1:
                success = True
                
                # Check if the element is inside the building or outside (part of the ground)
                relations = [is_inside(element, [building_curve]) for element in elements]
                                
                # Generate a roof mesh
                roof = rg.Mesh()
                
                # Generate a ground elements mesh
                ground_elements = rg.Mesh()
                
                # Iterate over the splitted elements and the relations
                for element, relation in zip(elements, relations):
                    # If the element is inside the roof outline
                    if relation:
                        # Add the element to the roof mesh
                        roof.Append(element)
                    else:
                        # Add the element to the ground mesh
                        ground_elements.Append(element)
                    
                # Add the roof mesh to the temp roofs for this building
                temp_roofs.Append(roof)
                
                # Overwrite the mesh plane to the ground elements
                mesh_plane = ground_elements
            else:
                print("Splitting did not result in multiple elements")
        
        # Check if this building has courtyards
        if len(courtyard_curve_set) > 0 and success:
            # Iterate over the polylines in the courtyards
            for i, courtyard_curve in enumerate(courtyard_curve_set):
                # Generate a splitter for the courtyard
                splitter = rg.Mesh.CreateFromCurveExtrusion(courtyard_curve, rg.Vector3d(0,0,2), params, bbox)
                
                # Split the roofs of this building by the courtyard splitter
                elements = temp_roofs.Split(splitter)

                # If the splitting resulted in more than one mesh
                if len(elements) > 1:
                    # Check if the element is inside the courtyard or outside (part of the roof)     
                    relations = [is_inside(element, [courtyard_curve]) for element in elements]
                    
                    # Generate a new roof mesh
                    roof = rg.Mesh()
                    
                    # Store the courtyard elements
                    courtyard_elements = rg.Mesh()
                    
                    # Iterate over the splitted elements from the roof
                    for element, relation in zip(elements, relations):
                        # If the roof is inside the courtyard
                        if relation:
                            # Add to the courtyard elements
                            courtyard_elements.Append(element)
                        else:
                            # Add to the roof elements
                            roof.Append(element)
                            temp_roofs = element
                    
                    # Add the courtyard elements to the mesh plane
                    mesh_plane.Append(courtyard_elements)
                else:
                    print('Splitting did not result in multiple elements')
        
        if success:
            # Add the roof to the list of roofs
            roofs.append(roof)
            valid.append(True)
        else:
           valid.append(False)
   
    # Postprocess the ground mesh plane mesh
    ground = postprocess_mesh(mesh_plane)
    
    heights = [height for i, height in enumerate(heights) if valid[i]]
    
    # Iterate over the roof meshes to translate to the correct height
    for i, (mesh, height) in enumerate(zip(roofs, heights)):
        # Generate a duplicate translated mesh
        translated_mesh = mesh.Duplicate()
        
        # Create a transform based on the height
        transform = rg.Transform.Translation(System.Double(0.0),System.Double(0.0),System.Double(height))
        
        # Move the mesh
        translated_mesh.Transform(transform)
        
        # Set the translated mesh after postprocessing
        roofs[i] = postprocess_mesh(translated_mesh)
    
    for i, roof in enumerate(roofs):
        if len(roof.Vertices) < 3:
            valid[i] = False
        elif len(roof.Faces) == 0:
            valid[i] = False

    invalid_idxs = []
    for i, val in enumerate(valid):
        if not val:
            invalid_idxs.append(i)

    return ground, roofs, invalid_idxs

' --- REMESHING --- '

def remesh_horizontal(mesh):
    """Remesh horizontal mesh elements

    Args:
        mesh (rg.Mesh): horizontal mesh

    Returns:
        rough_mesh (rg.Mesh): reduced
    """
    
    rough_mesh = mesh.Duplicate()
    
    rough_mesh.Reduce(100, False, 3, False, False)

    return rough_mesh

def remesh_vertical(curve, height):
    """Mesh vertical elements by using outlines and height

    Args:
        outlines (list[rg.Polyline]): building outlines
        height (list[float]): heights of the buildings
    Returns:
        mesh (rg.Mesh): reduced mesh
    """
    if curve.ClosedCurveOrientation() == rg.CurveOrientation.Clockwise:
        curve.Reverse()
        
    extrusion = rg.Extrusion.Create(curve, height, False)
    
    params = rg.MeshingParameters.QualityRenderMesh
    
    return rg.Mesh.CreateFromSurface(extrusion, params)

def triangulate_quad(quad_mesh):
    tri_mesh = quad_mesh.Duplicate()
    tri_mesh.Faces.ConvertQuadsToTriangles()
    return tri_mesh

def generate_mesh(patch_outline, building_outlines, courtyard_outlines, building_heights, grid_size, size, rough=False, logger=False):
    """Generate a patch mesh based on a patch outline, building polylines and courtyard outlines

    Args:
        patch_outline (rg.Rectangle3d): ground patch outline
        building_outlines (list[list[rg.Polyline]]): building outline polylines
        courtyard_outlines (list[list[rg.Polyline]]): courtyard outline polylines
        building_heights (list[float]): heights per building
        grid_size (float): grid size
        size (float): size of patch
        rough (bool, optional): Indicate if function should also return rough meshes. Defaults to False.

    Returns:
        mesh_plane (rg.Mesh): ground mesh plane
        walls (list[rg.Mesh]): walls
        roofs (list[rg.Mesh]): roofs
        rough_ground (rg.Mesh, optional), rough ground mesh
        rough_walls (list[rg.Mesh], optional): rough walls
        rough_roofs (list(rg.Mesh), optional): rough roofs
    """
    
    building_polylines, building_curves = project_outlines_to_world_xy(building_outlines)
    courtyard_polylines, courtyard_curves = project_outlines_to_world_xy(courtyard_outlines)
    
#    ground_mesh, building_meshes, building_polylines, courtyard_polylines, all_heights = _generate_horizontal(patch_outline, building_polylines, courtyard_polylines, building_heights, grid_size, size)
    mesh_plane, roofs, valid = generate_horizontal(patch_outline, building_polylines, courtyard_polylines, building_curves, courtyard_curves, building_heights, grid_size, size)
    
    # Overwite invalid outlines and heights
    building_polylines = [i for j, i in enumerate(building_polylines) if j not in valid]
    building_curves = [i for j, i in enumerate(building_curves) if j not in valid]
    courtyard_polylines = [i for j, i in enumerate(courtyard_polylines) if j not in valid]
    courtyard_curves = [i for j, i in enumerate(courtyard_curves) if j not in valid]
    building_heights = [i for j, i in enumerate(building_heights) if j not in valid]
    

    
    # Generate the walls for the building outlines and compute corresponding heights
    # Requires outlines in format polylines
    walls = generate_vertical(building_polylines, courtyard_polylines, building_heights, grid_size)
    
    # Compute the mesh plane for the ground and roofs
    # Requires outlines in format curves    
    if rough:        
        rough_ground = remesh_horizontal(mesh_plane)
        rough_roofs = [remesh_horizontal(roof) for roof in roofs]
        
        rough_walls = []
        for building, courtyard, height in zip(building_curves, courtyard_curves, building_heights):
            mesh = rg.Mesh()
            
            for curve in building:
                mesh.Append(remesh_vertical(curve, height))
            
            for curve in courtyard:
                mesh.Append(remesh_vertical(curve, height))
                
            rough_walls.append(mesh)
        
        return mesh_plane, walls, roofs, rough_ground, rough_walls, rough_roofs
    else:
        return mesh_plane, walls, roofs, None, None, None

' --- SENSORS --- '
def join_meshes(meshes):
    joined_meshes = rg.Mesh()
    for mesh in meshes:
        joined_meshes.Append(mesh)
    
    return joined_meshes

def get_face_vertices(face, mesh):
    # vertex_0 = rg.Point3d(mesh.Vertices[face.A].X, mesh.Vertices[face.A].Y, mesh.Vertices[face.A].Z)
    # vertex_1 = rg.Point3d(mesh.Vertices[face.B].X, mesh.Vertices[face.B].Y, mesh.Vertices[face.B].Z)
    # vertex_2 = rg.Point3d(mesh.Vertices[face.C].X, mesh.Vertices[face.C].Y, mesh.Vertices[face.C].Z)
    # vertex_3 = rg.Point3d(mesh.Vertices[face.D].X, mesh.Vertices[face.D].Y, mesh.Vertices[face.D].Z)
    
    vertices = [rg.Point3d(mesh.Vertices[vertex].X, mesh.Vertices[vertex].Y, mesh.Vertices[vertex].Z)
                for vertex in (face.A, face.B, face.C, face.D)]
    
    if face.IsQuad:
        return vertices[:4]
    else:
        return vertices[:3]

def delete_invalid_sensors(mesh, sensors, normals, minimum_angle = _MINIMUM_ANGLE, minimum_area=_MINIMUM_AREA):
    """_summary_

    Args:
        mesh (rg.Mesh): mesh to iterate over the faces
        sensors (list[rg.Point3d]): list of sensors
        normals (list[rg.Vector3d]): list of normals for the sensors
        minimum_angle (float, optional): Minimum corner angle for the face. Defaults to _MINIMUM_ANGLE.
        minimum_area (_type_, optional): _description_. Defaults to _MINIMUM_AREA.
    """
    
    # Iterate over the mesh faces
    for i, face in enumerate(mesh.Faces):
        
        # Check if the face is a triangle
        if face.IsTriangle:
            # Get the vertices of the face
            vertices = get_face_vertices(face, mesh)
            
            # Generate a triangle from the vertices
            triangle = rg.Triangle3d(vertices[0], vertices[1], vertices[2])
            
            # Find the lowest angle of the triangle
            min_angle = min([triangle.AngleA, triangle.AngleB, triangle.AngleC])
            
            # If the minimum angle is lower than acceptable or the area is lower than acceptable,
            # set the sensor and normal to a None value
            if min_angle < minimum_angle:
                sensors[i] = None
                normals[i] = None
            elif triangle.Area < minimum_area:
                sensors[i] = None
                normals[i] = None

    return sensors, normals

def offset_points(points, vectors, offset):
    """Offset points using numpy in the direction of a vector

    Args:
        points (list[rg.Point3d]): list of points to offset
        vectors (list[rg.Vector3d]): list of vectors to use for the offset
        offset (float): distance to offset

    Returns:
        points (list[rg.Point3d]): list of offsetted points
    """    
    offset_vectors = [rg.Vector3d(vector) * offset for vector in vectors]
    offset_points = [point + vector for point, vector in zip(points, vectors)]
    
    return offset_points

def is_above_mesh(point, meshes, ray_vector=rg.Vector3d(0,0,-1)):
    """Check if a point is above any of a list of meshes

    Args:
        point (rg.Point3d): point
        meshes (list[rg.mesh]): list of meshes
        ray_vector (rg.Vector3d, optional): Direction to check intersection. Defaults to rg.Vector3d(0,0,-1).

    Returns:
        bool: True if above any of the meshes
    """
    ray = rg.Ray3d(point, ray_vector)
    
    for mesh in meshes:
        if rg.Intersect.Intersection.MeshRay(mesh, ray) > 0:
            return True

    return False

def roof_ray_intersection(point, roofs, face_height, offset):
    """Check if a point intersects with a list of roofs, based on a maximum distance. If this
    is the case, offset the point.

    Args:
        point (rg.Point3d): point
        roofs (list[rg.Mesh]): list of roof meshes to check
        face_height (float): height of the face for the corresponding sensorpoint mesh
        offset (float): distance to offset

    Returns:
        bool: True if point intersects
        point (rg.Point3d): offsetted point if offesetted else original point
    """
    
    # Generate an upward ray
    upwards_vector = rg.Vector3d(0,0,1)
    ray = rg.Ray3d(point, upwards_vector)
    
    # Iterate over the roofs
    for roof in roofs:
        # Compute the distance between roof and point
        distance = rg.Intersect.Intersection.MeshRay(roof, ray)
        
        # Check if the distance is smaller than half the face height
        if 0 < distance < 0.5 * face_height:
            
            # Offset the point
            point += upwards_vector * distance + rg.Vector3d(0,0,offset)
            return True, point 

    return False, point

def wall_ray_intersection(point, normal, walls, grid_size, offset, tolerance=_WALL_RAY_TOLERANCE):
    """Compute the intersection between a point on a wall and a list of wall meshes. If the
    intersection is close enough, move the point to the intersection + an offset

    Args:
        point (rg.Point3d): point on a wall
        normal (rg.Vector3d): normal for the point on the wall
        walls (list[rg.Mesh]): list of wall meshes
        grid_size (float): grid size
        offset (float): offset distance
        tolerance (f;pat, optional): Intersection tolerance. Defaults to _WALL_RAY_TOLERANCE.

    Returns:
        success (bool): True if intersection occured
        point (rg.Point): offsetted point if offesetted else original point
    """
    
    # Hrnrtate an upward vector
    upwards_vector = rg.Vector3f(0,0,1)
    
    # Compute the perpendicular vector in relation to the normals
    left_vector = rg.Vector3f.CrossProduct(normal, upwards_vector)
    right_vector = -left_vector
    
    # Convert the vectors to rays
    left_ray = rg.Ray3d(point, rg.Vector3d(left_vector))
    right_ray = rg.Ray3d(point, rg.Vector3d(right_vector))
    
    # Store the success value
    success = False
    
    # Iterate over the walls
    for wall in walls:
        
        # Compute the intersections to the left and right
        left_distance = rg.Intersect.Intersection.MeshRay(wall, left_ray)
        right_distance = rg.Intersect.Intersection.MeshRay(wall, right_ray)
        
        # Check if the intersection is close enough
        if 0 < left_distance < 0.5 * grid_size - tolerance:
            if left_distance < right_distance:
                # Move the point
                left_vector = rg.Vector3d.Multiply(rg.Vector3d(left_vector), left_distance + offset)
                point += left_vector
                success = True
                break
        
        # Check if the intersection is close enough
        elif 0 < right_distance < 0.5 * grid_size - tolerance:
            if right_distance < left_distance:
                # Move the point
                right_vector = rg.Vector3d.Multiply(rg.Vector3d(right_vector), right_distance + offset)
                point += right_vector
                success = True
                break

    return success, point

def compute(ground, roofs, walls, building_heights, grid_size, offset, quad_only=QUAD_ONLY, logger=False):
    """Compute the sensorpoints for building meshes

    Args:
        ground (rg.Mesh): ground mesh
        roofs (list[rg.Mesh]): list of roof meshes
        walls (list[rg.Mesh]): list of wall meshes
        building_heights (list[float]): list of corresponding building height
        grid_size (float): grid size
        offset (float): offset value for the sensorpoints
        quad_only (bool, optional): Indicate if quad faces should be computed only. Defaults to QUAD_ONLY.

    Returns:
        sensorpoints (list[rg.Point3d]): sensorpoints
        normals (list[rg.Vector3d])): normals for the sensorpoints
    """
    
    # Store the sensorpoints and normals of the sensorpoints            
    sensorpoints = []
    normals = []
    
    # Compute the centroids and normals for the ground mesh
    ground_normals = list(ground.FaceNormals)
    ground_centroids = [ground.Faces.GetFaceCenter(System.Int32(i)) for i in range(ground.Faces.Count)] 
    
    # Offset the ground centroids
    ground_centroids = offset_points(ground_centroids, ground_normals, offset)
    
    
    # Delete the invalid sensors for the ground
    ground_centroids, ground_normals = delete_invalid_sensors(ground, ground_centroids, ground_normals)
    

    # Compute the centroids and normals for the roof meshes
    joined_roofs = join_meshes(roofs)
    roof_normals = joined_roofs.FaceNormals
    roof_centroids = [joined_roofs.Faces.GetFaceCenter(System.Int32(i)) for i in range(joined_roofs.Faces.Count)]
    
    # Offset the roof centroids
    roof_centroids = offset_points(roof_centroids, roof_normals, offset)
    
    # Append the computed centroids to the sensors
    sensorpoints.extend(ground_centroids)
    sensorpoints.extend(roof_centroids)
    
    # Append the computed centroid normals to the normals
    normals.extend(ground_normals)
    normals.extend(roof_normals)
    
    # Join the ground and roof into one mesh
    meshes = [ground] + roofs
    joined_meshes = join_meshes(meshes)
    
    # Join the walls into one mesh
    joined_walls = join_meshes(walls)
    
    # Iterate over all the walls
    for i, (wall, height) in enumerate(zip(walls, building_heights)):
        # Compute the face normals for the wall
        wall.FaceNormals.ComputeFaceNormals()
        
        # Get the face centroids for the wall
        wall_sensors = [wall.Faces.GetFaceCenter(j) for j in range(wall.Faces.Count)]
        
        # Offset the face centroids
        wall_sensors = offset_points(wall_sensors, wall.FaceNormals, offset)
        
        # Compute the height of one face
        face_height = height / int(math.ceil(height / grid_size))    
        
        # Iterate over the points and normals in the wall mesh
        for point, normal in zip(wall_sensors, wall.FaceNormals):
            
            # Check if the point is above a horizontal surface
            if is_above_mesh(point, [joined_meshes]):
                
                # If this is the case, add the centroids to sensors and normals to normals
                sensorpoints.append(point)
                normals.append(normal)
              
            # Check if the sensorpoints are under the corresponding walls' roof (because of splitting error)
            # Sometimes the ground is not splitted properly so wall points seem to be floating in space
            elif is_above_mesh(point, [meshes[i+1]], ray_vector=rg.Vector3d(0,0,1)):
                
                # If this is the case, add the centroids to sensors and normals to normals
                sensorpoints.append(point)
                normals.append(normal)
            
            # The centroid is floating under a roof            
            
            else:
                # Try to move the sensorpoint to close roof + offset
                success, point = roof_ray_intersection(point, [joined_roofs], face_height, offset)
                
                if not success:
                    # Try to move the sensorpoint to close wall + offset
                    success, point = wall_ray_intersection(point, normal, [joined_walls], grid_size, offset)
                    
                    
                    if not success:
                        # Set this point and normal value to None, thus it is invalid
                        point = None
                        normal = None
                    
                # Append the invalid point and normal
                sensorpoints.append(point)
                normals.append(normal)
            
        
    # Only compute the sensors for quad faces, skip the triangle faces at the borders of buildings    
    if quad_only:
        # Join all the meshes together in one list
        meshes = [ground] + roofs + walls
        
        # Generate a single mesh
        joined_mesh = rg.Mesh()
        for mesh in meshes:
            joined_mesh.Append(mesh)
        
        # Generate a single mesh with all horizontal meshes
        horizontal_mesh = rg.Mesh()
        for mesh in meshes:
            horizontal_mesh.Append(mesh)
        
        # Store the new sensorpoints and normals
        new_sensorpoints = []
        new_normals = []
        
        # Iterate over the faces, points and normals
        for face, point, normal in zip(horizontal_mesh.Faces, sensorpoints, normals):
            
            # Check if the face is a triangle face
            if not face.IsTriangle:
                # The face is a quad, so add the point and normal to new sensors and normals
                new_sensorpoints.append(point)
                new_normals.append(normal)
            else:
                # Append a None value, it is a triangle
                new_sensorpoints.append(None)
                new_normals.append(None)
        
        # Overwrite the sensorpoints and normals
        sensorpoints = new_sensorpoints
        normals = new_normals
    
    return sensorpoints, normals

def filter_sensors(sensorpoints, normals):
    """Filter points and normals based on None values

    Args:
        sensorpoints (list): list of rg.Point3d and None values
        normals (list): list of rg.Vector3d and None values

    Returns:
        filtered_points (list[rg.Point3d]): filtered points
        filtered_normals (list[rg.Vector3d]): filtered normals
        pointmap (list[bool]): list indicating if point was None or not for restoration in postprocessing
    """
    
    # Store the results
    filtered_points = []
    filtered_normals = []
    pointmap = []

    # Iterate over points and normals
    for point, normal in zip(sensorpoints, normals):
        # Check if the point is None
        if point is not None:
            filtered_points.append(point)
            filtered_normals.append(normal)
            pointmap.append(True)
        else:
            pointmap.append(False)
    
    return filtered_points, filtered_normals, pointmap

def main():
    # Extract roof and wall meshes from 3D BAG dataset
    roof_meshes, wall_meshes, bbox = load(static_context)
    
    # Generate the building outlines for ALL building meshes
    all_building_outlines, all_heights = extract_building_outlines(wall_meshes, roof_meshes)
    
    for i, polyline_set in enumerate(all_building_outlines):
        for j, polyline in enumerate(polyline_set):
            all_building_outlines[i][j], intersect = fix_self_intersections(polyline)
            
    # Sort the building_outlines to inners and outers
    for i, (building_outline, height) in enumerate(zip(all_building_outlines, all_heights)):
        # If there are inner courtyards
        if len(building_outline) > 1:
            outers, inners = find_outer_polyline(building_outline)
            
            if len(inners) > 0:
                all_building_outlines[i] = outers + inners
            else:
                all_building_outlines[i] = [outers[0]]
                
                for outer in outers[1:]:
                    all_building_outlines.append([outer])
                    all_heights.append(height)
    
    # Serialization required if computing multiple patches
    # Serialize the building outlines to avoid in-place changes
    # all_building_outlines = serialize.serialize(all_building_outlines)
    
    # Deserialize the building outlines
    # deserializeed_building_outlines = serialize.deserialize(all_building_outlines)
    
    patch_outline = outline
    
    building_outlines, courtyard_outlines, heights, FSI_score, envelope_area, building_area, idxs = generate_building_outlines(
        patch_outline, 
        all_building_outlines, 
        all_heights)
    
    building_curves = []
    for outlines in building_outlines:
        building_curves.append([out.ToNurbsCurve() for out in outlines])
    
    # Sometimes a building outline is accidently a courtyard, this is fixed here:
    pops = []
    # Iterate over potential courtyards
    for i, potential_courtyards in enumerate(building_outlines):
        for potential_courtyard in potential_courtyards:
            
            # Iterate over buildings
            for j, curves in enumerate(building_curves):
                for curve in curves:
                    inside = []
                    
                    for point in potential_courtyard:
                        if curve.Contains(point, rg.Plane.WorldXY) == rg.PointContainment.Inside:
                            inside.append(True)
                        else:
                            #This is not a potential courtyard for this building
                            inside.append(False)
                            break
                    
                    if all(inside):
                        courtyard_outlines[j].append(potential_courtyard)
                        pops.append(i)
                        
    building_outlines = [i for j, i in enumerate(building_outlines) if j not in pops]
    courtyard_outlines = [i for j, i in enumerate(courtyard_outlines) if j not in pops]
    heights = [i for j, i in enumerate(heights) if j not in pops]
    
    # Generate meshes
    ground, walls, roofs, rough_ground, rough_walls, rough_roofs = generate_mesh(
        patch_outline, 
        building_outlines, 
        courtyard_outlines, 
        heights, 
        GRID_SIZE, 
        SIZE, 
        rough=True)
    
    context = []
    for i, (roof, wall) in enumerate(zip(roof_meshes, wall_meshes)):
        if i not in idxs:
            context.append(roof)
            context.append(wall)
    
#    context = join_meshes(context)
    problem = rough_walls
    return ground, walls, roofs, heights, context, problem

def evaluate(ground, walls, roofs):
    expected_area = SIZE **2
    ground_area = rg.AreaMassProperties.Compute(ground).Area
    
    roof_areas = [rg.AreaMassProperties.Compute(roof).Area for roof in roofs]
    
    tot_area = sum([ground_area] + roof_areas)
    
    if abs(expected_area - tot_area) > 10:
        print('WRONG')
    else:
        print('CORRECT')
    

if __name__ == '__main__':
    ground, static_walls, static_roofs, static_heights, context, problem = main()
    mesh = join_meshes([ground, static_roofs, static_walls])

    evaluate(ground, static_walls, static_roofs)
# ---------- end preprocess ----------
# ----
# Visualize Context
context_extraction = ContextExtraction(mesh=mesh, curve=sample_outline_curve)  # -> i, list
custom_preview = CustomPreview(Geometry=context_extraction.i, Material=ColourSwatch(SwatchColor=RGB(255, 255, 255)))
custom_preview_2 = CustomPreview(Geometry=mesh_2, Material=ColourSwatch(SwatchColor=RGB(242, 242, 242)))

# ----
# Design Preprocessing
curve_2 = Curve(<curve referenced from the Rhino model>)
height = Slider(15, range=0..50)
grid_size = Slider(1, range=0..1)

area = Area(Geometry=curve_2, UseTasks=False)  # -> Area, Centroid
xy_plane = XYPlane(Origin=area.Centroid)
# Adjust design
rotate = Rotate(Geometry=curve_2, Angle=degrees(rotation_angle), Plane=xy_plane)  # -> Geometry, Transform

preprocess_design = GhPythonScript(
    building_curve=rotate.Geometry,
    ground=preprocess.ground,
    height=height,
    outline=sample_outline_curve,
    grid_size=grid_size)  # -> out, dynamic_walls, dynamic_roofs, ground; inputs outline: Rectangle3d
# ---------- preprocess_design: Python ----------
__author__ = "Job de Vogel"
__version__ = "2024.02.23"

import rhinoscriptsyntax as rs
import math
import Rhino.Geometry as rg
import System

ghenv.Component.Message = 'Version 1.0\nDeveloped by Job de Vogel'

_REDUCE_SEGMENTS_TOLERANCE = 0.001
_MESH_SPLITTER_BBOX_HEIGHT = 2
_ANGLE_TOLERANCE_POSTP_MESH = math.pi/90
_DIAGONAL_LENGTH_RATIO_POSTP_MESH = 0.01

def mesh_extrude_polyline(polyline, height, grid_size):
    """Extrude a polyline to a mesh

    Args:
        polyline (rg.Polyline): polyline
        height (float): height of the building
        grid_size (float): approximate size of the mesh faces

    Returns:
        meshh (rg.Mesh): wall mesh
    """
    vertices = []
    faces = []
    
    # Reduce the number of segments to a minimum
    polyline.ReduceSegments(_REDUCE_SEGMENTS_TOLERANCE)
    
    # Extract the segments to a list
    segments = polyline.GetSegments()
    
    # Get the lengths of each segment
    lengths = [segment.Length for segment in segments]
    
    # Compute how many faces each segment should have in horizonal direction
    num_segments = [int(math.ceil(length / grid_size)) for length in lengths]
    
    # Compute how many faces each segment should have in vertical directioin
    levels = int(math.ceil(height / grid_size))
    
    # Total number of faces in horizontal directtion
    num_p = sum(num_segments)
    
    # Vertices on the ground level
    base_vertices = []
    
    # Vertices all together
    vertices = []
    
    # Iterate over the segments
    for segment, num_segment in zip(segments, num_segments):
        
        # Iterate over the number of segments
        for i in range(num_segment):
            parameter = i * (1 / num_segment)
            
            # Add the vertex to the base vertices
            base_vertices.append(segment.PointAt(parameter))
    
    # Iterate over the vertical levels
    for j in range(levels + 1):
        parameter = j * (height / levels)
        
        # Iterate over the base vertices
        for vertex in base_vertices:
            # Add a base vertex at each level
            vertices.append(rg.Point3d(vertex.X, vertex.Y, vertex.Z + parameter))
    
    # Generate the mesh faces
    faces = System.Array[rg.MeshFace]([
        rg.MeshFace(i + j * num_p, i + (j + 1) * num_p, (i + 1) % num_p + (j + 1) * num_p, (i + 1) % num_p + j * num_p)
        for j in range(levels)
        for i in range(num_p)
    ])
    
    # Initialize a new mesh
    mesh = rg.Mesh()
    
    # Add the vertices and faces to the mesh
    mesh.Vertices.AddVertices(System.Array[rg.Point3d](vertices))
    mesh.Faces.AddFaces(faces)
    
    return mesh

def postprocess_mesh(mesh, check=False):
    """Postprocess a mesh such that there are no invalid faces or vertices

    Args:
        mesh (rg.Mesh): mesh
        check (bool, optional): Check if the mesh is valid. Defaults to False.

    Returns:
        mesh (rg.Mesh): postprocessd mesh
    """
    
    # Convert triangle faces to quad
    mesh.Faces.ConvertTrianglesToQuads(_ANGLE_TOLERANCE_POSTP_MESH, _DIAGONAL_LENGTH_RATIO_POSTP_MESH)
    
    # Get vertices and faces    
    vertices = mesh.Vertices
    faces = mesh.Faces
    
    # Initialize a rebuild mesh
    rebuild_mesh = rg.Mesh()

    # Add the mesh vertices and faces to the rebuild mesh
    rebuild_mesh.Vertices.AddVertices(vertices)
    rebuild_mesh.Faces.AddFaces(faces)
    
    # Check if the mesh is valid
    if check:
        print('Adding vertices and faces: {}'.format(rebuild_mesh.IsValidWithLog()))
    
    # Compute the normals
    rebuild_mesh.Normals.ComputeNormals()
    
    # Check if the mesh is valid
    if check:
        print('Computing normals: {}'.format(rebuild_mesh.IsValidWithLog()))
    
    # Transform the mesh to a compact shape
    rebuild_mesh.Compact()
    
    # Check if the mesh is valid
    if check:
        print('Compact: {rebuild_mesh.IsValidWithLog()}'.format(rebuild_mesh.IsValidWithLog()))
        
    # Cull degenerate faces
    rebuild_mesh.Faces.CullDegenerateFaces()
    
    # Check if the mesh is valid
    if check:
        print('Cull degenerate faces: {}'.format(rebuild_mesh.IsValidWithLog()))
    
    # Delete zero area mesh faces
    indices =  rebuild_mesh.Faces.GetZeroAreaFaces()[1]
    rebuild_mesh.Faces.DeleteFaces(indices, True)
    
    indices =  rebuild_mesh.Faces.GetZeroAreaFaces()[2]
    rebuild_mesh.Faces.DeleteFaces(indices, True)
        
    return rebuild_mesh

def generate_roof(building_outline, mesh_plane, ground_plane, size):
    # Generate the splitters from the inner and outer polylines
    params = rg.MeshingParameters.QualityRenderMesh
    bbox = rg.BoundingBox(0,0,-_MESH_SPLITTER_BBOX_HEIGHT,size,size,_MESH_SPLITTER_BBOX_HEIGHT)
    
    # Generate a mesh splitter (extra unit on -z side)
    splitter = rg.Mesh.CreateFromCurveExtrusion(building_outline, rg.Vector3d(0,0,1), params, bbox)
    
    elements = mesh_plane.Split(splitter)
    
    # Postprocess the mesh elements
    ground = postprocess_mesh(elements[0])
    
    elements = ground_plane.Split(splitter)
    
    # Postprocess the mesh elements
    roof = postprocess_mesh(elements[1])
    
    return ground, roof
    
box_interval = rg.Box(outline.BoundingBox)
plane_width = rg.Interval(box_interval.X[0], box_interval.X[1])
plane_height = rg.Interval(box_interval.Y[0], box_interval.Y[1])
plane = rg.Plane.WorldXY

# Compute the number of face divisions for the mesh plane    
width_divisions = System.Int32(int(plane_width.Length / grid_size))
length_divisions = System.Int32(int(plane_height.Length / grid_size))

# Generate the mesh plane
ground_mesh = rg.Mesh.CreateFromPlane(plane, plane_width, plane_height, width_divisions, length_divisions)   
    
wall_curve = rg.PolylineCurve.Duplicate(building_curve)
#a = mesh_extrude_polyline(x, 10, 1.0)
ground, roof = generate_roof(building_curve, ground, ground_mesh, 100)

wall = mesh_extrude_polyline(wall_curve.ToPolyline(), height, 1.0)

# Generate a duplicate translated mesh
roof = roof.Duplicate()

# Create a transform based on the height
transform = rg.Transform.Translation(System.Double(0.0),System.Double(0.0),System.Double(height))

# Move the mesh
roof.Transform(transform)

dynamic_walls = [wall]
dynamic_roofs = [roof]
# ---------- end preprocess_design ----------

preprocessing = GhPythonScript(
    dynamic_walls=preprocess_design.dynamic_walls,
    dynamic_roofs=preprocess_design.dynamic_roofs,
    ground=preprocess_design.ground,
    static_walls=preprocess.static_walls,
    static_roofs=preprocess.static_roofs,
    static_heights=preprocess.static_heights)  # -> out, data, sensors, pointmap, mesh; inputs dynamic_walls: list of Mesh, dynamic_roofs: list of Mesh, ground: Mesh, static_walls: list of Mesh, static_roofs: list of Mesh, static_heights: list
# ---------- preprocessing: Python ----------
__author__ = "Job de Vogel"
__version__ = "2024.01.15"

import sys
import math
import time
import System
import Rhino.Geometry as rg
import os
import ghpythonlib.treehelpers as th
ghenv.Component.Message = 'Version 1.0\nDeveloped by Job de Vogel'

GRID_SIZE = 1.0
OFFSET = 0.01
QUAD_ONLY = False

_MINIMUM_ANGLE = 0.017
_MINIMUM_AREA = 0.0001
_WALL_RAY_TOLERANCE = 0.1

def join_meshes(meshes):
    joined_meshes = rg.Mesh()
    for mesh in meshes:
        joined_meshes.Append(mesh)
    
    return joined_meshes

def get_face_vertices(face, mesh):
    # vertex_0 = rg.Point3d(mesh.Vertices[face.A].X, mesh.Vertices[face.A].Y, mesh.Vertices[face.A].Z)
    # vertex_1 = rg.Point3d(mesh.Vertices[face.B].X, mesh.Vertices[face.B].Y, mesh.Vertices[face.B].Z)
    # vertex_2 = rg.Point3d(mesh.Vertices[face.C].X, mesh.Vertices[face.C].Y, mesh.Vertices[face.C].Z)
    # vertex_3 = rg.Point3d(mesh.Vertices[face.D].X, mesh.Vertices[face.D].Y, mesh.Vertices[face.D].Z)
    
    vertices = [rg.Point3d(mesh.Vertices[vertex].X, mesh.Vertices[vertex].Y, mesh.Vertices[vertex].Z)
                for vertex in (face.A, face.B, face.C, face.D)]
    
    if face.IsQuad:
        return vertices[:4]
    else:
        return vertices[:3]

def delete_invalid_sensors(mesh, sensors, normals, minimum_angle = _MINIMUM_ANGLE, minimum_area=_MINIMUM_AREA):
    """_summary_

    Args:
        mesh (rg.Mesh): mesh to iterate over the faces
        sensors (list[rg.Point3d]): list of sensors
        normals (list[rg.Vector3d]): list of normals for the sensors
        minimum_angle (float, optional): Minimum corner angle for the face. Defaults to _MINIMUM_ANGLE.
        minimum_area (_type_, optional): _description_. Defaults to _MINIMUM_AREA.
    """
    
    # Iterate over the mesh faces
    for i, face in enumerate(mesh.Faces):
        
        # Check if the face is a triangle
        if face.IsTriangle:
            # Get the vertices of the face
            vertices = get_face_vertices(face, mesh)
            
            # Generate a triangle from the vertices
            triangle = rg.Triangle3d(vertices[0], vertices[1], vertices[2])
            
            # Find the lowest angle of the triangle
            min_angle = min([triangle.AngleA, triangle.AngleB, triangle.AngleC])
            
            # If the minimum angle is lower than acceptable or the area is lower than acceptable,
            # set the sensor and normal to a None value
            if min_angle < minimum_angle:
                sensors[i] = None
                normals[i] = None
            elif triangle.Area < minimum_area:
                sensors[i] = None
                normals[i] = None

    return sensors, normals

def offset_points(points, vectors, offset):
    """Offset points using numpy in the direction of a vector

    Args:
        points (list[rg.Point3d]): list of points to offset
        vectors (list[rg.Vector3d]): list of vectors to use for the offset
        offset (float): distance to offset

    Returns:
        points (list[rg.Point3d]): list of offsetted points
    """    
    offset_vectors = [rg.Vector3d(vector) * offset for vector in vectors]
    offset_pts = [point + vector for point, vector in zip(points, offset_vectors)]
    
    return offset_pts

def is_above_mesh(point, meshes, ray_vector=rg.Vector3d(0,0,-1)):
    """Check if a point is above any of a list of meshes

    Args:
        point (rg.Point3d): point
        meshes (list[rg.mesh]): list of meshes
        ray_vector (rg.Vector3d, optional): Direction to check intersection. Defaults to rg.Vector3d(0,0,-1).

    Returns:
        bool: True if above any of the meshes
    """
    ray = rg.Ray3d(point, ray_vector)
    
    for mesh in meshes:
        if rg.Intersect.Intersection.MeshRay(mesh, ray) > 0:
            return True

    return False

def roof_ray_intersection(point, roofs, face_height, offset):
    """Check if a point intersects with a list of roofs, based on a maximum distance. If this
    is the case, offset the point.

    Args:
        point (rg.Point3d): point
        roofs (list[rg.Mesh]): list of roof meshes to check
        face_height (float): height of the face for the corresponding sensorpoint mesh
        offset (float): distance to offset

    Returns:
        bool: True if point intersects
        point (rg.Point3d): offsetted point if offesetted else original point
    """
    
    # Generate an upward ray
    upwards_vector = rg.Vector3d(0,0,1)
    ray = rg.Ray3d(point, upwards_vector)
    
    # Iterate over the roofs
    for roof in roofs:
        # Compute the distance between roof and point
        distance = rg.Intersect.Intersection.MeshRay(roof, ray)
        
        # Check if the distance is smaller than half the face height
        if 0 < distance < 0.5 * face_height:
            
            # Offset the point
            point += upwards_vector * distance + rg.Vector3d(0,0,offset)
            return True, point 

    return False, point

def wall_ray_intersection(point, normal, walls, grid_size, offset, tolerance=_WALL_RAY_TOLERANCE):
    """Compute the intersection between a point on a wall and a list of wall meshes. If the
    intersection is close enough, move the point to the intersection + an offset

    Args:
        point (rg.Point3d): point on a wall
        normal (rg.Vector3d): normal for the point on the wall
        walls (list[rg.Mesh]): list of wall meshes
        grid_size (float): grid size
        offset (float): offset distance
        tolerance (f;pat, optional): Intersection tolerance. Defaults to _WALL_RAY_TOLERANCE.

    Returns:
        success (bool): True if intersection occured
        point (rg.Point): offsetted point if offesetted else original point
    """
    
    # Hrnrtate an upward vector
    upwards_vector = rg.Vector3f(0,0,1)
    
    # Compute the perpendicular vector in relation to the normals
    left_vector = rg.Vector3f.CrossProduct(normal, upwards_vector)
    right_vector = -left_vector
    
    # Convert the vectors to rays
    left_ray = rg.Ray3d(point, rg.Vector3d(left_vector))
    right_ray = rg.Ray3d(point, rg.Vector3d(right_vector))
    
    # Store the success value
    success = False
    
    # Iterate over the walls
    for wall in walls:
        
        # Compute the intersections to the left and right
        left_distance = rg.Intersect.Intersection.MeshRay(wall, left_ray)
        right_distance = rg.Intersect.Intersection.MeshRay(wall, right_ray)
        
        # Check if the intersection is close enough
        if 0 < left_distance < 0.5 * grid_size - tolerance:
            if left_distance < right_distance:
                # Move the point
                left_vector = rg.Vector3d.Multiply(rg.Vector3d(left_vector), left_distance + offset)
                point += left_vector
                success = True
                break
        
        # Check if the intersection is close enough
        elif 0 < right_distance < 0.5 * grid_size - tolerance:
            if right_distance < left_distance:
                # Move the point
                right_vector = rg.Vector3d.Multiply(rg.Vector3d(right_vector), right_distance + offset)
                point += right_vector
                success = True
                break

    return success, point

def compute(ground, roofs, walls, building_heights, grid_size, offset, quad_only=QUAD_ONLY, logger=False):
    """Compute the sensorpoints for building meshes

    Args:
        ground (rg.Mesh): ground mesh
        roofs (list[rg.Mesh]): list of roof meshes
        walls (list[rg.Mesh]): list of wall meshes
        building_heights (list[float]): list of corresponding building height
        grid_size (float): grid size
        offset (float): offset value for the sensorpoints
        quad_only (bool, optional): Indicate if quad faces should be computed only. Defaults to QUAD_ONLY.

    Returns:
        sensorpoints (list[rg.Point3d]): sensorpoints
        normals (list[rg.Vector3d])): normals for the sensorpoints
    """
    
    ground.Normals.ComputeNormals()
    
    # Store the sensorpoints and normals of the sensorpoints            
    sensorpoints = []
    normals = []
    
    # Compute the centroids and normals for the ground mesh
    ground_normals = list(ground.FaceNormals)
    ground_centroids = [ground.Faces.GetFaceCenter(System.Int32(i)) for i in range(ground.Faces.Count)] 

    # Offset the ground centroids
    ground_centroids = offset_points(ground_centroids, ground_normals, offset)
    
    # Delete the invalid sensors for the ground
    ground_centroids, ground_normals = delete_invalid_sensors(ground, ground_centroids, ground_normals)
    

    # Compute the centroids and normals for the roof meshes
    joined_roofs = join_meshes(roofs)
    roof_normals = joined_roofs.FaceNormals
    roof_centroids = [joined_roofs.Faces.GetFaceCenter(System.Int32(i)) for i in range(joined_roofs.Faces.Count)]
    
    # Offset the roof centroids
    roof_centroids = offset_points(roof_centroids, roof_normals, offset)
    
    # Append the computed centroids to the sensors
    sensorpoints.extend(ground_centroids)
    sensorpoints.extend(roof_centroids)
    
    # Append the computed centroid normals to the normals
    normals.extend(ground_normals)
    normals.extend(roof_normals)
    
    # Join the ground and roof into one mesh
    meshes = [ground] + roofs
    joined_meshes = join_meshes(meshes)
    
    # Join the walls into one mesh
    joined_walls = join_meshes(walls)
    
    # Iterate over all the walls
    for i, (wall, height) in enumerate(zip(walls, building_heights)):
        # Compute the face normals for the wall
        wall.FaceNormals.ComputeFaceNormals()
        
        # Get the face centroids for the wall
        wall_sensors = [wall.Faces.GetFaceCenter(j) for j in range(wall.Faces.Count)]
        
        # Offset the face centroids
        wall_sensors = offset_points(wall_sensors, wall.FaceNormals, offset)
        
        # Compute the height of one face
        face_height = height / int(math.ceil(height / grid_size))    
        
        # Iterate over the points and normals in the wall mesh
        for point, normal in zip(wall_sensors, wall.FaceNormals):
            
            # Check if the point is above a horizontal surface
            if is_above_mesh(point, [joined_meshes]):
                
                # If this is the case, add the centroids to sensors and normals to normals
                sensorpoints.append(point)
                normals.append(normal)
              
            # Check if the sensorpoints are under the corresponding walls' roof (because of splitting error)
            # Sometimes the ground is not splitted properly so wall points seem to be floating in space
            elif is_above_mesh(point, [meshes[i+1]], ray_vector=rg.Vector3d(0,0,1)):
                
                # If this is the case, add the centroids to sensors and normals to normals
                sensorpoints.append(point)
                normals.append(normal)
            
            # The centroid is floating under a roof            
            
            else:
                # Try to move the sensorpoint to close roof + offset
                success, point = roof_ray_intersection(point, [joined_roofs], face_height, offset)
                
                if not success:
                    # Try to move the sensorpoint to close wall + offset
                    success, point = wall_ray_intersection(point, normal, [joined_walls], grid_size, offset)
                    
                    
                    if not success:
                        # Set this point and normal value to None, thus it is invalid
                        point = None
                        normal = None
                    
                # Append the invalid point and normal
                sensorpoints.append(point)
                normals.append(normal)
            
        
    # Only compute the sensors for quad faces, skip the triangle faces at the borders of buildings    
    if quad_only:
        # Join all the meshes together in one list
        meshes = [ground] + roofs + walls
        
        # Generate a single mesh
        joined_mesh = rg.Mesh()
        for mesh in meshes:
            joined_mesh.Append(mesh)
        
        # Generate a single mesh with all horizontal meshes
        horizontal_mesh = rg.Mesh()
        for mesh in meshes:
            horizontal_mesh.Append(mesh)
        
        # Store the new sensorpoints and normals
        new_sensorpoints = []
        new_normals = []
        
        # Iterate over the faces, points and normals
        for face, point, normal in zip(horizontal_mesh.Faces, sensorpoints, normals):
            
            # Check if the face is a triangle face
            if not face.IsTriangle:
                # The face is a quad, so add the point and normal to new sensors and normals
                new_sensorpoints.append(point)
                new_normals.append(normal)
            else:
                # Append a None value, it is a triangle
                new_sensorpoints.append(None)
                new_normals.append(None)
        
        # Overwrite the sensorpoints and normals
        sensorpoints = new_sensorpoints
        normals = new_normals
    
    return sensorpoints, normals

def filter_sensors(sensorpoints, normals):
    """Filter points and normals based on None values

    Args:
        sensorpoints (list): list of rg.Point3d and None values
        normals (list): list of rg.Vector3d and None values

    Returns:
        filtered_points (list[rg.Point3d]): filtered points
        filtered_normals (list[rg.Vector3d]): filtered normals
        pointmap (list[bool]): list indicating if point was None or not for restoration in postprocessing
    """
    
    # Store the results
    filtered_points = []
    filtered_normals = []
    pointmap = []

    # Iterate over points and normals
    for point, normal in zip(sensorpoints, normals):
        # Check if the point is None
        if point is not None:
            filtered_points.append(point)
            filtered_normals.append(normal)
            pointmap.append(True)
        else:
            pointmap.append(False)
    
    return filtered_points, filtered_normals, pointmap

if dynamic_roofs != [None]:
    roofs = static_roofs + dynamic_roofs
else:
    roofs = static_roofs

if dynamic_walls != [None]:
    walls = static_walls + dynamic_walls
else:
    walls = static_walls

heights = static_heights

if dynamic_walls != [None]:
    for wall in dynamic_walls:
        height = max([vertex.Z for vertex in wall.Vertices])
        heights.append(height)

if ground != None and roofs != [None] and walls != [None] and heights != [None]: 
    start = time.time()
    # Compute the sensorpoints for this sample
    sensorpoints, sensornormals = compute(ground, roofs, walls, heights, GRID_SIZE, OFFSET)
    
    ## Filter out the None values for invalid sensors
    filtered_points, filtered_normals, pointmap = filter_sensors(sensorpoints, sensornormals)
    end = time.time()
#    print('Sensor extraction timing: {}s'.format(end-start))
    
    sensors = filtered_points
    
    sensor_data = [[point.X, point.Y, point.Z] for point in sensors]
    normal_data = [[normal.X, normal.Y, normal.Z] for normal in filtered_normals]
    
    data = th.list_to_tree([sensor_data[i] + normal_data[i] for i in range(len(sensor_data))], source=[])
    
    mesh = join_meshes([ground, roofs, walls])
# ---------- end preprocessing ----------

# ----
# Batch Client
# The solar irradiation values are
# predicted through a client-server system. First,
# the server is booted which loads all the required
#  packages. Then the client receives data from
# Grasshopper and sends it to the server, which is
#  waiting for new data. The server uses Python 3
# with a Pytorch network based on PointNeXt.
#  The prediction values are then sent back to the
# client and visualized in Grasshopper.
time = BooleanToggle(False)
autocast = BooleanToggle(False)
cudnn = BooleanToggle(False)
deterministic = BooleanToggle(False)
pre_compile_model = BooleanToggle(False)
batch_size = Slider(1, range=0..10)
sub_batch_size = Slider(1, range=0..10)
pytorch_settings = GhPythonScript(
    time_it=time,
    batch_size=batch_size,
    sub_batch_size=sub_batch_size,
    autocast=autocast,
    cudnn=cudnn,
    deterministic=deterministic,
    compile=pre_compile_model,
    synchronize=time)  # -> settings; inputs time_it: Boolean, batch_size: Int32, sub_batch_size: Int32, autocast: Boolean, cudnn: Boolean, deterministic: Boolean, compile: Boolean, synchronize: Boolean
# ---------- pytorch_settings: Python ----------
__author__ = "Job de Vogel"
__version__ = "2024.06.28"

import Grasshopper.Kernel as gh
error = gh.GH_RuntimeMessageLevel.Error
warning = gh.GH_RuntimeMessageLevel.Warning

if time_it == None: time_it = False
if batch_size == None: batch_size = 1
if sub_batch_size == None: sub_batch_size = 1

if not (batch_size / sub_batch_size).is_integer():
    msg = 'batch_size division by sub_batch_size does not result in whole number ({}/{} = {}).'.format(batch_size, sub_batch_size, batch_size/sub_batch_size)
    ghenv.Component.AddRuntimeMessage(error, msg)

if autocast == None: autocast = False
if cudnn == None: cudnn = True
if deterministic == None: deterministic = False
if compile == None: compile = False
if synchronize == None: synchronize = False

if time_it and not synchronize:
    msg = 'You are timing the execution without synchronizing cuda operations.'
    ghenv.Component.AddRuntimeMessage(warning, msg)

if overwrite_model_path == None: overwrite_model_path = None

settings = [time_it, batch_size, sub_batch_size, autocast, cudnn, deterministic, compile, synchronize, overwrite_model_path]
# ---------- end pytorch_settings ----------
irradiancenet = ValueList({"s": "irradiancenet-s", "b": "irradiancenet-b", "l": "irradiancenet-l", "xl": "irradiancenet-xl"}, selected="l")
run_the_client = BooleanToggle(False)
resend_to_server = Button()
client = GhPythonScript(
    model=irradiancenet,
    port=port_to_exchange_data,
    data=preprocessing.data,
    run=run_the_client,
    refresh=resend_to_server,
    settings=pytorch_settings)  # -> out, irradiation; inputs data: tree, refresh: Boolean, settings: list
# ---------- client: Python ----------
__author__ = "Job de Vogel"
__version__ = "2024.02.18"

def closest_higher_power_of_2(number):
    # If number is already a power of 2, return the number itself
    if number & (number - 1) == 0:
        return number

    # Shift the bits to the left until finding the next power of 2
    next_power_of_2 = 1
    while next_power_of_2 < number:
        next_power_of_2 <<= 1

    return next_power_of_2

def depth(l):
    if isinstance(l, list):
        return 1 + max(depth(item) for item in l)
    else:
        return 0

if run and not refresh:
    import os
    import time
    import socket
    import sys
    import math
    import base64
    import json
    import ghpythonlib.treehelpers as th
    import sys
    
    HOST = 'localhost'  # The server's hostname or IP address
    PORT = int(port) # The port used by the server

    if settings == []:
        time_it = False
        batch_size = 1
        sub_batch_size = 1
        autocast = True
        cudnn = True
        deterministic = False
        compile = False
        synchronize = False
        overwrite_model_path = None
        
        settings = [time_it, batch_size, sub_batch_size, autocast, cudnn, deterministic, compile, synchronize, overwrite_model_path]
    
    data = th.tree_to_list(data, False)
    
    if depth(data) == 2:
        data = [data]
    elif depth(data) == 3:
        pass
    else:
        raise Exception("Incorrect data depth")
    
    # Set kwargs if not received
    kwargs = settings
    
    # Compute the required buffer size based on the data to send
    req_buffer_size = closest_higher_power_of_2(len(str(data).encode()))
    
    # Initialize the socket
    s = socket.socket(socket.AF_INET, socket.SOCK_STREAM)
    try:
        start = time.time()
        
        # Connect and send the required buffer size
        s.connect((HOST, PORT))
        s.send(str(req_buffer_size).encode())
        
        # Send the data packaged as encoded json string
        data = str(json.dumps([model, data, kwargs]))
        
#        with open("C:\Users\Job de Vogel\Desktop\data.json", "w") as file:
#            json.dump(data, file)
#        
#        print("Saved to " + "C:\Users\Job de Vogel\Desktop\data.json")
#        sys.exit()
        s.sendall(data.encode())
        
        # Receive the computed data back from the server
        data = s.recv(req_buffer_size).decode()
        i, model_name, irradiance = json.loads(data)
        
        irradiation = th.list_to_tree(irradiance, None)
        
        end = time.time()
        print('Forward pass run iteration {} timing {}s'.format(i, round(end-start, 3)))
        
        if model_name != '':
            print("Server msg: " + "server built {}".format(model_name))
        if int(i) == 0:
            print("Warning: this was the initial run. This run most likely cost more time to run then following requests.")
    except Exception as e:
        print "Error:", e
    finally:
        s.close()
# ---------- end client ----------

point = Point(preprocessing.sensors)

# ----
# Visualize
gradient = Gradient(
    LowerLimit=0,
    UpperLimit=1000,
    Parameter=simplify(client.irradiation),
    stops=[0: RGB(75, 107, 169), 0.199: RGB(173, 203, 249), 0.5: RGB(254, 244, 84), 0.748: RGB(234, 126, 0), 1: RGB(234, 38, 0)])
mesh_4 = Mesh(preprocessing.mesh)
visualize_mesh = GhPythonScript(mesh=mesh_4, pointmap=preprocessing.pointmap, colors=gradient)  # -> out, mesh; inputs pointmap: list, colors: list
# ---------- visualize_mesh: Python ----------
__author__ = "Job de Vogel"
__version__ = "2024.02.23"

import rhinoscriptsyntax as rs
import System
import random

def colorMeshFaces(mesh, pointmap, colors):
    
    """ Unwelds and color the faces of the mesh in place """
    black = rs.CreateColor([0,0,0])
    
    colors = iter(colors)
    
    mesh.VertexColors.CreateMonotoneMesh(System.Drawing.Color.Black)
    mesh.Unweld(0,False)
    for i, point in enumerate(pointmap):
        if point == True:
            mesh.VertexColors.SetColor(mesh.Faces[i],next(colors))
        else:
            mesh.VertexColors.SetColor(mesh.Faces[i],black)
    
    return mesh
    
try:
    a = colorMeshFaces(mesh, pointmap, colors)
except:
    pass
# ---------- end visualize_mesh ----------

cloud_display = CloudDisplay(Points=point, Colours=gradient, Size=0.4, SpriteType=1)

# ----
# Feature Extraction
deconstruct_mesh = DeconstructMesh(Mesh=mesh_3)  # -> Vertices, Faces, Colours, Normals
face_normals = FaceNormals(Mesh=mesh_3)  # -> Centers, Normals
dispatch = Dispatch(List=deconstruct_mesh.Faces, DispatchPattern=preprocessing.pointmap)  # -> ListA, ListB
dispatch_2 = Dispatch(List=face_normals.Centers, DispatchPattern=preprocessing.pointmap)  # -> ListA, ListB
dispatch_3 = Dispatch(List=face_normals.Normals, DispatchPattern=preprocessing.pointmap)  # -> ListA, ListB
deconstruct_vector = DeconstructVector(Vector=dispatch_3.ListA)  # -> XComponent, YComponent, ZComponent
equality = Equality(FirstNumber=deconstruct_vector.ZComponent, SecondNumber=0)  # -> Equality, Inequality
stream_filter = StreamFilter(Gate=type, Stream0=equality.Equality, Stream1=equality.Inequality)
dispatch_4 = Dispatch(List=client.irradiation, DispatchPattern=stream_filter)  # -> ListA, ListB
dispatch_5 = Dispatch(List=dispatch.ListA, DispatchPattern=stream_filter)  # -> ListA, ListB
dispatch_6 = Dispatch(List=dispatch_2.ListA, DispatchPattern=stream_filter)  # -> ListA, ListB
dispatch_7 = Dispatch(List=colors, DispatchPattern=stream_filter)  # -> ListA, ListB
larger_than = LargerThan(FirstNumber=dispatch_4.ListA, SecondNumber=minimum_kwh_m2)  # -> LargerThan, OrEqualTo
dispatch_8 = Dispatch(List=dispatch_5.ListA, DispatchPattern=larger_than.LargerThan)  # -> ListA, ListB
dispatch_9 = Dispatch(List=dispatch_4.ListA, DispatchPattern=larger_than.LargerThan)  # -> ListA, ListB
dispatch_10 = Dispatch(List=dispatch_6.ListA, DispatchPattern=larger_than.LargerThan)  # -> ListA, ListB
dispatch_11 = Dispatch(List=dispatch_7.ListA, DispatchPattern=larger_than.LargerThan)  # -> ListA, ListB
construct_mesh = ConstructMesh(Vertices=deconstruct_mesh.Vertices, Faces=dispatch_8.ListA)
cloud_display_2 = CloudDisplay(Points=dispatch_10.ListA, Colours=dispatch_11.ListA, Size=0.5, SpriteType=1)
area_2 = Area(Geometry=construct_mesh)  # -> Area, Centroid
deconstruct_mesh_2 = DeconstructMesh(Mesh=construct_mesh)  # -> Vertices, Faces, Colours, Normals
suirify = Suirify(area_2.Area)
text_join = TextJoin(Text=["-   ", " m2 surface area", suirify])
deconstruct_face = DeconstructFace(Face=deconstruct_mesh_2.Faces)  # -> CornerA, CornerB, CornerC, CornerD
text_join_2 = TextJoin(Text=["-   ", "> ", minimum_kwh_m2, " kWh/m2"])
list_item = ListItem(List=deconstruct_mesh_2.Vertices, Index=deconstruct_face.CornerA, Wrap=True)  # -> graft(Item)
list_item_2 = ListItem(List=deconstruct_mesh_2.Vertices, Index=deconstruct_face.CornerB, Wrap=True)  # -> graft(Item)
list_item_3 = ListItem(List=deconstruct_mesh_2.Vertices, Index=deconstruct_face.CornerC, Wrap=True)  # -> graft(Item)
list_item_4 = ListItem(List=deconstruct_mesh_2.Vertices, Index=deconstruct_face.CornerD, Wrap=True)  # -> graft(Item)
construct_mesh_2 = ConstructMesh(Vertices=simplify([list_item, list_item_4, list_item_3, list_item_2]), Faces={A=0, B=1, C=2, D=3})
area_3 = Area(Geometry=construct_mesh_2, UseTasks=False)  # -> flatten(Area), Centroid
multiplication = Multiplication(A=simplify(graft(dispatch_9.ListA)), B=simplify(graft(area_3.Area)))  # -> flatten(Result)
mass_addition = MassAddition(Input=multiplication)  # -> Result, PartialResults
multiplication_2 = Multiplication(A=mass_addition.Result, B=solar_panel_annual_efficiency)
suirify_2 = Suirify(multiplication_2)
suirify_3 = Suirify(multiplication_2)
text_join_3 = TextJoin(Text=["-   ", suirify_3, " kWh solar panel potential"])
power_generation_potential_kwh = Panel(suirify_2)
area_with_higher_irradiation_than_tresho = Panel(area_2.Area)  # "Area with higher irradiation than treshold (m2)"

area_with_higher_irradiation_than_tresho_2 = Panel(area_2.Area)  # "Area with higher irradiation than treshold (m2)"; disabled
power_generation_potential_kwh_2 = Panel(multiplication_2)  # disabled

# ----
# Optimization Procedure
# Rotation angle of tower design
# x1000
# x1000
rotation_angle_2 = Slider(10, range=0..359)
list_length = ListLength(List=dispatch_4.ListA)  # -> expr("x*1000", Length); disabled
mass_addition_2 = MassAddition(Input=dispatch_4.ListA)  # -> Result, PartialResults; disabled
mass_addition_3 = MassAddition(Input=dispatch_4.ListB)  # -> Result, PartialResults; disabled
list_length_2 = ListLength(List=dispatch_4.ListB)  # -> expr("x*1000", Length); disabled
division = Division(A=mass_addition_2.Result, B=list_length)  # disabled
division_2 = Division(A=mass_addition_3.Result, B=list_length_2)  # disabled
panel = Panel("1")  # disabled
subtraction = Subtraction(A=panel, B=division)  # disabled
addition = Addition(A=subtraction, B=division_2)  # disabled
fitness = Panel(addition)  # disabled
galapagos = Galapagos(fitness=addition, gene=rotation_angle_2)

data = Data([text_join_2, text_join_3, text_join])

text_join_4 = TextJoin(Text=flatten(["Solar Irradiation Potential", data]))

text = Text(text_join_4)

# ==== cluster ContextExtraction
curve = ClusterInput()
curve_2 = Curve(curve)
unit_z = UnitZ(Factor=Slider(100, range=0..100))
mesh = ClusterInput()
negative = Negative(Value=unit_z)
extrude = Extrude(Base=curve_2, Direction=[unit_z, negative])
mesh_2 = Mesh(mesh)
brep_join = BrepJoin(Breps=extrude)  # -> Breps, Closed
cap_holes = CapHoles(Brep=brep_join.Breps)
bounding_box = BoundingBox(Content=mesh_2, Plane=PlaneXY(0, 0, 0))  # -> Box, Box_2
deconstruct_box = DeconstructBox(Box=bounding_box.Box)  # -> Plane, X, Y, Z
disjoint_mesh = DisjointMesh(Mesh=mesh_2)
mesh_3 = Mesh(cap_holes)
plane_surface = PlaneSurface(Plane=deconstruct_box.Plane, XSize=deconstruct_box.X, YSize=deconstruct_box.Y)
mesh_difference = MeshDifference(MeshesA=disjoint_mesh, MeshesB=mesh_3)
surface_split = SurfaceSplit(Surface=plane_surface, Curves=curve_2)
list_item = ListItem(List=surface_split, Index=0, Wrap=True)
deconstruct_mesh = DeconstructMesh(Mesh=mesh_difference)  # -> Vertices, Faces, Colours, Normals
i = ClusterOutput(list_item)
list_item_2 = ListItem(List=deconstruct_mesh.Vertices, Index=0, Wrap=True)
point_in_brep = PointInBrep(Brep=cap_holes, Point=list_item_2, Strict=False, UseTasks=False)
cull_pattern = CullPattern(List=mesh_difference, CullPattern=invert(flatten(point_in_brep)))
list = ClusterOutput(cull_pattern)
