# Grasshopper definition load_data.gh (Grasshopper 1.0.7)
# Copyright: Job de Vogel

data_recorder = DataRecorder(Button(), DataLimit=1000, RecordData=True)
list_length = ListLength(List=data_recorder)  # -> expr("x/2", Length)
trigger = Trigger(Interval=5000, TimerInterval=5000)  # disabled
panel = Panel(list_length)
ghpython_script = GhPythonScript(index=Slider(0, range=-101..1000))  # -> out, idx, path, aug, name, meshes, points, irradiance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
# ---------- ghpython_script: Python ----------
__author__ = "Job de Vogel"
__version__ = "2023.07.26"

import Rhino.Geometry as rg
import ghpythonlib.treehelpers as th
import json

import glob
import os

# Load a mesh from a json file
def load_mesh_from_json(path):
#    path = folder + "/" + name + ".json"
    with open(path, "r") as file:
        data = json.load(file)

    meta = data['meta']
    data.pop('meta')
    meshes = []
    
    visualization = None
    
    for key in data.keys():
        mesh = rg.Mesh.FromJSON(data[key])
        
        if key == 'visualization':
            visualization = mesh
        else:
            meshes.append(mesh)
    
    return meshes, meta, visualization

def load_array_as_list(path):
    with open(path, 'r') as file:
        data = json.load(file)
    
    data = json.loads(data)
        
    # with open(file, 'rb') as file:
    #     data = pickle.load(file)
    
    return data

# Load a mesh from a json file
def load_outlines_from_json(path):
    with open(path, "r") as file:
        data = json.load(file)

    curves = []
    for key in data.keys():
        curves.append(rg.NurbsCurve.FromJSON(data[key]))

    return curves

def get_latest_file(dir):
    files = os.listdir(dir)
    paths = [os.path.join(dir, basename) for basename in files]

    latest_file = max(paths, key=os.path.getctime)
    
    return latest_file, paths

def main():
    path = 'C:\\Users\\Job de Vogel\\OneDrive\\Documenten\\TU Delft\\Master Thesis\\Code\\IrradianceNet\\data\\geometry'
    
    if overwrite_folder != None:
        path = overwrite_folder
    
    subfolders = []
    for file in os.listdir(path):
        d = os.path.join(path, file)
        if os.path.isdir(d):
            subfolders.append(d)
    
    if len(subfolders) == 0:
        print('Warning: taking samples from path ' + str(path))
        subfolders.append(path)
    
    latest_files = []
    all_files = []

    for folder in subfolders:
        try:
            latest_file, files = get_latest_file(folder)
            all_files.extend(files)
            latest_files.append(latest_file)
        except:
            pass
    
    if index != None:
        latest_file = all_files[int(index)]
    else:
        latest_file = max(latest_files, key=os.path.getctime)
    
    name = latest_file.split("\\")[-1]
    idx = int(name[5:-10])
    aug = name[-9:-5]
    
    if aug == 'base':
        aug = 0
    else:
        aug = int(aug[-1])
    
    irr_path = latest_file.replace('geometry', 'irradiance').replace('mesh', 'sensors')
    
    meshes, meta, visualization = load_mesh_from_json(latest_file)
    irradiance = load_array_as_list(irr_path)
    irr_flipped = list(zip(*irradiance))
    
    points = [rg.Point3d(x, y, z) for x, y, z in zip(irr_flipped[0], irr_flipped[1], irr_flipped[2])]
    irradiance = irr_flipped[6]

    meshes = th.list_to_tree(meshes)
    
    path = latest_file
    
    outlines_path = latest_file.replace('geometry', 'outlines').replace('mesh', 'outlines')
    outlines = load_outlines_from_json(outlines_path)
    
    return meshes, points, irradiance, outlines, meta, visualization, idx, aug, name, path

meshes, points, irradiance, outlines, meta, visualization, idx, aug, name, path = main()
# ---------- end ghpython_script ----------
geometry = Geometry(<brep referenced from the Rhino model>)
data = Data(ghpython_script.outlines)
data_2 = Data(ghpython_script.meshes)

file_path = FilePath("C:\Users\Job de Vogel\OneDrive\Documenten\TU Delft\Master Thesis\Code\IrradianceNet\data\bag\9-284-556-LoD12-3D.obj")
python_script = PythonScript(File_Paths=file_path, Translate=Toggle(True), Level_Ground=Toggle(True), parallel=Toggle(False), run=Toggle(True))  # -> out, mesh, local_meshes, roof_meshes, wall_meshes, bbox; inputs File_Paths: list
# ---------- python_script: Python ----------
import Rhino.Geometry as rg
from ghpythonlib import parallel
from ghpythonlib import treehelpers

import warnings
import sys

def load_obj(path):
    with open(path) as file:
        lines = file.readlines()
    
    vertices=[]
    faces=[]
    
    for line in lines:
        if line.find("v")==0 and line.find("n")==-1 and line.find("t")==-1:
            vertices.Add(rg.Point3d(float((line.split(' '))[1]),float((line.split(' '))[2]),float((line.split(' '))[3])))
        if line.find("f")==0:
            if line.split(' ').Count==4:
                faces.Add(rg.MeshFace(int(line.split(' ')[1].split('/')[0])-1,int(line.split(' ')[2].split('/')[0])-1,int(line.split(' ')[3].split('/')[0])-1))
            if line.split(' ').Count==5:
                faces.Add(rg.MeshFace(int(line.split(' ')[1].split('/')[0])-1,int(line.split(' ')[2].split('/')[0])-1,int(line.split(' ')[3].split('/')[0])-1,int(line.split(' ')[4].split('/')[0])-1))
    
    mesh = rg.Mesh()
    for vertex in vertices:
        mesh.Vertices.Add(vertex)
    
    for face in faces:
        mesh.Faces.AddFace(face)
    
    mesh.Normals.ComputeNormals()
    mesh.Compact()
    mesh.MergeAllCoplanarFaces(0.01)
    
    return mesh

def translate_mesh(mesh, bbox):
    center = bbox.Center
    x, y = center[0], center[1]

    mesh.Translate(-x, -y, 0)
    brepBoundingBox = bbox.ToBrep()
    brepBoundingBox.Translate(-x, -y, 0)
    
    return mesh, brepBoundingBox

def get_bbox(mesh):
    xyPlane = rg.Plane(rg.Point3d(0.0, 0.0, 0.0), rg.Vector3d(0.0, 0.0, 1.0))
    boundingBox = mesh.GetBoundingBox(xyPlane)
    
    return boundingBox

def partition_mesh(mesh):
    roofMesh = rg.Mesh()
    roofMesh.CopyFrom(mesh)
    roofFacesIdxs = []
    
    wallMesh = rg.Mesh()
    wallMesh.CopyFrom(mesh)
    wallFacesIdxs = []
    
    floorMesh = rg.Mesh()
    floorMesh.CopyFrom(mesh)
    floorFacesIdxs = []
    
    for i, normal in enumerate(mesh.FaceNormals):
        if normal.Z > 0:
            roofFacesIdxs.append(i)
        elif normal.Z == 0:
            wallFacesIdxs.append(i)
        else:
            floorFacesIdxs.append(i)
    
    valid = True
    if len(floorFacesIdxs) == 0 or len(wallFacesIdxs) == 0 or len(roofFacesIdxs) == 0:
        valid = False
        warnings.warn("File contains meshes without roofs, walls or floors.")
        
        return valid, roofMesh, wallMesh, floorMesh
        
    roofMesh.Faces.DeleteFaces(wallFacesIdxs + floorFacesIdxs)
    wallMesh.Faces.DeleteFaces(roofFacesIdxs + floorFacesIdxs)
    floorMesh.Faces.DeleteFaces(roofFacesIdxs + wallFacesIdxs)
    
    roofMesh.Compact()
    wallMesh.Compact()
    floorMesh.Compact()
    
    return valid, roofMesh, wallMesh, floorMesh

def level_mesh(mesh, roof_mesh, wall_mesh, floor_mesh):
    height = floor_mesh.Faces.GetFaceCenter(0).Z
    
    mesh.Translate(0, 0, -height)
    roof_mesh.Translate(0, 0, -height)
    wall_mesh.Translate(0, 0, -height)
    floor_mesh.Translate(0, 0, -height)
    
    return mesh, roof_mesh, wall_mesh, floor_mesh

def main(path):
    mesh = load_obj(path)
    
    if Translate:
        mesh, bbox = translate_mesh(mesh, get_bbox(mesh))
    else:
        bbox = get_bbox(mesh)
    
    if Level_Ground:
        global_mesh = rg.Mesh()
    else:
        global_mesh = mesh

    local_meshes = []
    local_roof_meshes = []
    local_wall_meshes = []
    local_floor_meshes = []
    
    for i, local_mesh in enumerate(mesh.SplitDisjointPieces()):
        valid, roof_mesh, wall_mesh, floor_mesh = partition_mesh(local_mesh)
        
        if not valid:
            continue
        
        if Level_Ground:
            local_mesh, roof_mesh, wall_mesh, floor_mesh = level_mesh(local_mesh, roof_mesh, wall_mesh, floor_mesh)
            global_mesh.Append(local_mesh)
        
        local_meshes.append(local_mesh)
        local_roof_meshes.append(roof_mesh)
        local_wall_meshes.append(wall_mesh)
        local_floor_meshes.append(floor_mesh)

    return mesh, local_meshes, local_roof_meshes, local_wall_meshes, local_floor_meshes, bbox

if __name__ == '__main__':
    if run:
        if parallel:
            if len(File_Paths) == 1:
                mesh, local_meshes, roof_meshes, wall_meshes, floor_meshes, bbox = main(File_Paths[0])
            else:
                results = parallel.run(main, File_Paths, False)
                mesh, local_meshes, roof_meshes, wall_meshes, floor_meshes, bbox = list(zip(*results))
                
                mesh = treehelpers.list_to_tree(mesh, source=[0])
                local_meshes = treehelpers.list_to_tree(local_meshes, source=[0])
                roof_meshes = treehelpers.list_to_tree(roof_meshes, source=[0])
                wall_meshes = treehelpers.list_to_tree(wall_meshes, source=[0])
                floor_meshes = treehelpers.list_to_tree(floor_meshes, source=[0])
                bbox = treehelpers.list_to_tree(bbox, source=[0])
        else:
            if len(File_Paths) == 1:
                mesh, local_meshes, roof_meshes, wall_meshes, floor_meshes, bbox = main(File_Paths[0])
            else:
                mesh = []
                local_meshes = []
                roof_meshes = []
                wall_meshes = []
                floor_meshes = []
                bbox = []
                for file in File_Paths:
                    tmp_mesh, tmp_local_meshes, tmp_roof_meshes, tmp_wall_meshes, tmp_floor_meshes, tmp_bbox = main(file)
                    mesh.append(tmp_mesh)
                    local_meshes.append(tmp_local_meshes)
                    roof_meshes.append(tmp_roof_meshes)
                    wall_meshes.append(tmp_wall_meshes)
                    floor_meshes.append(tmp_floor_meshes)
                    bbox.append(tmp_bbox)
                
                mesh = treehelpers.list_to_tree(mesh, source=[0])
                local_meshes = treehelpers.list_to_tree(local_meshes, source=[0])
                roof_meshes = treehelpers.list_to_tree(roof_meshes, source=[0])
                wall_meshes = treehelpers.list_to_tree(wall_meshes, source=[0])
#                floor_meshes = treehelpers.list_to_tree(floor_meshes, source=[0])
                bbox = treehelpers.list_to_tree(bbox, source=[0])
# ---------- end python_script ----------
envelope_size = Slider(100, range=0..1000)
minimum_coverage = Slider(25, range=0..100)
data_3 = Data(python_script.mesh)
ghpython_script_2 = GhPythonScript(bbox=python_script.bbox, size=envelope_size, min_coverage=minimum_coverage)  # -> out, ground_outlines; inputs bbox: Box
# ---------- ghpython_script_2: Python ----------
__author__ = "Job de Vogel"
__version__ = "2023.04.25"

import Rhino.Geometry as rg
import random

# Get the x,y domain of a bbox
def get_domain(bbox):
    print(bbox.GetCorners())
    x, y, _ = list(map(list, zip(*bbox.GetCorners())))
    print('\n')
    print(x,y)
    
    min_x = min(x)
    min_y = min(y)
    max_x = max(x)
    max_y = max(y)
    
    return (min_x, max_x), (min_y, max_y)

# Divide main domain into sub domains
def divide_domain(domain, size, min_coverage):
    min_x, max_x = domain[0]
    min_y, max_y = domain[1]
    
    x_size = abs(min_x) + abs(max_x)
    y_size = abs(min_y) + abs(max_y)
    
    step_size = size * min_coverage / 100
    x_steps = (x_size // step_size) - 1
    y_steps = (y_size // step_size) - 1
    
    sub_domains = []
    for i in range(int(x_steps)):
        for j in range(int(y_steps)):
            x_domain = (min_x + i * step_size, min_x + i * step_size + size)
            y_domain = (min_y + j * step_size, min_y + j * step_size + size)
            
            sub_domains.append((x_domain, y_domain))
    
    return sub_domains

# Generate bbox from domain and size
def create_bbox(domain, bottom_treshold):
    x_domain, y_domain = domain
    x_center = (x_domain[0] + x_domain[1]) / 2
    y_center = (y_domain[0] + y_domain[1]) / 2
    
    size = abs(x_domain[1] - x_domain[0])
    
    center = rg.Point3d(x_center, y_center, 0)
    plane = rg.Plane(center, rg.Vector3d(0, 0, 1))
    
    interv = rg.Interval(-0.5 * size, 0.5 * size)
    z_interv = rg.Interval(-0.1, size + 0.1)

    box = rg.Box(plane, interv, interv, z_interv)
    return box

def main():
    main_domain = get_domain(bbox)
    sub_domains = divide_domain(main_domain, size, min_coverage)
    
    outlines = []
    for domain in sub_domains:
        corner_0 = rg.Point3d(domain[0][0], domain[1][0], 0)
        corner_1 = rg.Point3d(domain[0][1], domain[1][1], 0)
        outlines.append(rg.Rectangle3d(rg.Plane.WorldXY, corner_0, corner_1))

    return outlines

ground_outlines = main()
# ---------- end ghpython_script_2 ----------
mesh_edges = MeshEdges(Mesh=python_script.local_meshes)  # -> NakedEdges, InteriorEdges, NonManifoldEdges
list_item = ListItem(List=ghpython_script_2.ground_outlines, Index=ghpython_script.idx, Wrap=True)
custom_preview = CustomPreview(Geometry=data_3, Material=ColourSwatch(SwatchColor=RGBA(181, 0, 0, 65)))
area = Area(Geometry=list_item)  # -> Area, Centroid
custom_preview_2 = CustomPreview(Geometry=mesh_edges.InteriorEdges, Material=ColourSwatch(SwatchColor=RGB(255, 255, 255)))
vector_2pt = Vector2Pt(PointA="0,0,0", PointB=area.Centroid, Unitize=False)  # -> Vector, Length
custom_preview_3 = CustomPreview(Geometry=mesh_edges.InteriorEdges, Material=ColourSwatch(SwatchColor=RGB(255, 255, 255)))
vector = Vector(vector_2pt.Vector)
# Global City model
move = Move(Geometry=data_2, Motion=vector)  # -> Geometry, Transform

mesh_join = MeshJoin(Meshes=ghpython_script.meshes)
number_slider = Slider(10000, range=0..20000)  # disabled
deconstruct_mesh = DeconstructMesh(Mesh=mesh_join)  # -> Vertices, Faces, Colours, Normals; disabled
list_length_2 = ListLength(List=deconstruct_mesh.Faces)  # disabled
# Base Pointnet Architecture input
subtraction = Subtraction(A=list_length_2, B=number_slider)  # disabled
random_reduce = RandomReduce(List=deconstruct_mesh.Faces, Reduction=subtraction, Seed=1)  # disabled
construct_mesh = ConstructMesh(Vertices=deconstruct_mesh.Vertices, Faces=random_reduce)  # disabled

custom_preview_4 = CustomPreview(Geometry=geometry, Material=ColourSwatch(SwatchColor=RGB(21, 184, 0)))
custom_preview_5 = CustomPreview(Geometry=python_script.roof_meshes, Material=ColourSwatch(SwatchColor=RGB(0, 0, 255)))
custom_preview_6 = CustomPreview(Geometry=python_script.wall_meshes, Material=ColourSwatch(SwatchColor=RGB(255, 0, 0)))
deconstruct_mesh_2 = DeconstructMesh(Mesh=python_script.local_meshes)  # -> Vertices, Faces, Colours, Normals

remap_numbers = RemapNumbers(Value=ghpython_script.irradiance, Source=Domain(0, 1000), Target=Domain(0, 1))  # -> Mapped, Clipped
gradient = Gradient(
    LowerLimit=0,
    UpperLimit=1,
    Parameter=remap_numbers.Mapped,
    stops=[0: RGB(0, 0, 0), 0.249: RGB(173, 203, 249), 0.5: RGB(254, 244, 84), 0.746: RGB(234, 126, 0), 1: RGB(234, 38, 0)])
symbol_simple = SymbolSimple(Style=5, Size=3, Rotation=0, Colour=gradient)
symbol_display = SymbolDisplay(Location=ghpython_script.points, Display=symbol_simple)

construct_mesh_2 = ConstructMesh(Vertices=deconstruct_mesh_2.Vertices, Faces=deconstruct_mesh_2.Faces)

ghpython_script_3 = GhPythonScript()  # -> out, a; inputs x: Polyline, y: Mesh
# ---------- ghpython_script_3: Python ----------
__author__ = "Job de Vogel"
__version__ = "2023.09.13"

import rhinoscriptsyntax as rs
import Rhino.Geometry as rg
import ghpythonlib.treehelpers as th

datas = [[(31.0, -27.814176559448242, -5.551115123125783e-17), (30.932199478149414, -28.0, 1.1102230246251565e-16), (30.90720558166504, -28.068498611450195, -5.551115123125783e-17), (30.932199478149414, -28.0, -5.551115123125783e-17), (31.0, -27.814176559448242, -5.551115123125783e-17)], [(-12.0,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

a = []
for data in datas:
    outline = rg.Polyline([rg.Point3d(pt[0], pt[1], pt[2]) for pt in data])
    a.append(outline)

a = th.list_to_tree(a, source=[0])
# ---------- end ghpython_script_3 ----------
# Read Outlines
polyline = PolyLine(Vertices=ghpython_script_3.a, Closed=False)  # -> flatten(Polyline)
list_item_2 = ListItem(List=polyline, Index=0, Wrap=True)

custom_preview_7 = CustomPreview(Geometry=construct_mesh_2, Material=ColourSwatch(SwatchColor=RGBA(178, 178, 178, 219)))
custom_preview_8 = CustomPreview(Geometry=list_item, Material=ColourSwatch(SwatchColor=RGB(0, 0, 0)))
move_2 = Move(Geometry=ghpython_script.outlines, Motion=vector)  # -> Geometry, Transform

data_4 = Data(ghpython_script.meshes)
list_item_3 = ListItem(List=move.Geometry, Index=0, Wrap=True)  # -> Item, Item1, Item2
custom_preview_9 = CustomPreview(Geometry=list_item_3.Item, Material=ColourSwatch(SwatchColor=RGB(0, 0, 255)))
custom_preview_10 = CustomPreview(Geometry=list_item_3.Item1, Material=ColourSwatch(SwatchColor=RGB(255, 0, 0)))
custom_preview_11 = CustomPreview(Geometry=list_item_3.Item2, Material=ColourSwatch(SwatchColor=RGB(21, 184, 0)))

mesh_join_2 = MeshJoin(Meshes=data_4)
colour_swatch = ColourSwatch(SwatchColor=RGBA(148, 148, 148, 219))
face_normals = FaceNormals(Mesh=mesh_join_2)  # -> Centers, Normals
mesh_join_3 = MeshJoin(Meshes=move.Geometry)
heatmap = LBSpatialHeatmap(values=ghpython_script.irradiance, mesh=mesh_join_3)  # -> mesh, legend, title, colors, legend_par; plug-in component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
deconstruct_mesh_3 = DeconstructMesh(Mesh=mesh_join_2)  # -> Vertices, Faces, Colours, Normals
panel_2 = Panel(face_normals.Normals)

# ----
# Mesh split verification
ghpython_script_4 = GhPythonScript()  # -> out, mesh_plane, splitter, checkpoints, result; disabled
# ---------- ghpython_script_4: Python ----------
__author__ = "Job de Vogel"
__version__ = "2023.09.22"

import rhinoscriptsyntax as rs

import Rhino.Geometry as rg
import json

def load(path):
    with open(path) as file:
        data = json.load(file)
        
        decoded = []
        for d in data:
            decoded.append(rg.Mesh.FromJSON(d))
    
    return decoded
    
mesh_plane = load('C:\\Users\\Job de Vogel\\Desktop\\mesh_plane.json')
splitter = load('C:\\Users\\Job de Vogel\\Desktop\\splitter.json')

checkpoints = [(11.686354160308838, 13.075285196304321, 3.469446951953614e-17),
(-11.111438751220703, -10.268966674804688, -8.326672684688674e-17),
(0.0, 0.0, 0.0),
(-16.0174503326416, -8.239943981170654, -3.5128150388530344e-17),
(-19.014963150024414, -7.000235915184021, 3.491130995403324e-17),
(-17.040935516357422, -7.816651940345764, 9.020562075079397e-17),
(-20.314545154571533, -6.462756156921387, 5.551115123125783e-17),
(-23.06071949005127, -5.320987820625305, 2.168404344971009e-19),
(0.0, 0.0, 0.0),
(0.0, 0.0, 0.0),
(-26.02121353149414, -4.051523447036743, 7.37257477290143e-18),
(-24.82132625579834, -4.566036939620972, -1.3877787807814457e-17),
(-23.995434284210205, -4.920180678367615, 4.336808689942018e-19),
(-26.801869869232178, -3.716776490211487, 1.3877787807814457e-17),
(-12.332953453063965, -15.085617065429688, -4.163336342344337e-17),
(-15.008889198303223, -14.004119157791138, 2.0599841277224584e-17),
(-13.655453205108643, -14.551119565963745, -2.7755575615628914e-17),
(-17.454520225524902, -13.015699863433838, -1.0191500421363742e-17),
(-18.598774433135986, -12.553241491317749, 1.1123914289701275e-16),
(-22.122392654418945, -11.129146099090576, 0.0),
(-21.497607707977295, -11.381657361984253, 4.336808689942018e-19),
(0.0, 0.0, 0.0)]

checkpoints = [rg.Point3d(p[0],p[1],p[2]) for p in checkpoints]

result = mesh_plane[0].Split(splitter[0])
print([len(element.Faces) for element in result])
# ---------- end ghpython_script_4 ----------
number_slider_2 = Slider(1, range=0..10)  # disabled
point = Point(ghpython_script_4.checkpoints)  # disabled
data_5 = Data(ghpython_script_4.splitter)  # disabled
data_6 = Data(ghpython_script_4.result)  # disabled
list_item_4 = ListItem(List=point, Index=number_slider_2, Wrap=True)  # disabled
list_item_5 = ListItem(List=data_6, Index=number_slider_2, Wrap=True)  # disabled

quad_remesh = QuadRemesh(Mesh=move.Geometry, Settings={aqc=True, as=50, dhe=True, gci=0, null=False, pme=0, sa=0, tqc=2000})
data_7 = Data(heatmap.mesh)
deconstruct = Deconstruct(Point=deconstruct_mesh_3.Vertices)  # -> XComponent, YComponent, ZComponent
sort_list = SortList(Keys=deconstruct.XComponent)  # -> reverse(Keys), ValuesValuesA
sort_list_2 = SortList(Keys=deconstruct.ZComponent)  # -> reverse(Keys), ValuesValuesA
sort_list_3 = SortList(Keys=deconstruct.YComponent)  # -> reverse(Keys), ValuesValuesA
list_item_6 = ListItem(List=sort_list.Keys, Index=0, Wrap=True)  # -> Item1, Item
list_item_7 = ListItem(List=sort_list_3.Keys, Index=0, Wrap=True)  # -> Item1, Item
list_item_8 = ListItem(List=sort_list_2.Keys, Index=0, Wrap=True)  # -> Item1, Item
number_slider_3 = Slider(2, range=1..126)  # disabled
number_slider_4 = Slider(0, range=0..200)  # disabled
merge = Merge(Data1=list_item_6.Item, Data2=list_item_7.Item, Data3=list_item_8.Item)
sort_list_4 = SortList(Keys=merge)  # -> reverse(Keys), ValuesValuesA
ghpython_script_5 = GhPythonScript(base_idx=number_slider_4, selected_idx=number_slider_3)  # -> out, base_values, selected_values, base_time, selected_time; disabled
# ---------- ghpython_script_5: Python ----------
__author__ = "Job de Vogel"
__version__ = "2023.10.03"

# Honeybee Core dependencies
from honeybee.model import Model

from lbt_recipes.recipe import Recipe
from lbt_recipes.settings import RecipeSettings

import csv
import json

import Rhino.Geometry as rg

path = r'C:\\Users\\Job de Vogel\\Desktop\\results.csv'

with open(path, 'r') as file:
    reader_variable = csv.reader(file, delimiter=",")
    for i, row in enumerate(reader_variable):
        if i == base_idx:
            base_values = [float(num) for num in row][:-1]
            base_time = float(row[-1])
        elif i == selected_idx:
            selected_values = [float(num) for num in row][:-1]
            selected_time = float(row[-1])

print('Available simulations: ' + str(i + 1))
# ---------- end ghpython_script_5 ----------
ghpython_script_6 = GhPythonScript()  # -> out, points; disabled
# ---------- ghpython_script_6: Python ----------
__author__ = "Job de Vogel"
__version__ = "2023.10.03"

# Honeybee Core dependencies
from honeybee.model import Model

from lbt_recipes.recipe import Recipe
from lbt_recipes.settings import RecipeSettings

import csv
import json

import Rhino.Geometry as rg

def load_array_as_list(path):
    with open(path, 'r') as file:
        data = json.load(file)
    
    data = json.loads(data)
        
    # with open(file, 'rb') as file:
    #     data = pickle.load(file)
    
    return data

path = 'C:\\Users\\Job de Vogel\\OneDrive\\Documenten\\TU Delft\\Master Thesis\\Dataset_pipeline\\dataset\\data\\irradiance\\sensors_450_base.json'

points = load_array_as_list(path)
points = list(zip(*points))

points = [rg.Point3d(x, y, z) for x, y, z in zip(points[0], points[1], points[2])]
# ---------- end ghpython_script_6 ----------
ghpython_script_7 = GhPythonScript(base_idx=number_slider_4, idx=number_slider_3)  # -> out, base_params, selected_params; inputs base_idx: Int32, idx: Int32; disabled
# ---------- ghpython_script_7: Python ----------
__author__ = "Job de Vogel"
__version__ = "2023.10.04"

arguments = ['-ab 14 -aa 0 -ar 4096 -ad 16384 -as 8192 -c 1 -dc 0.75 -dp 512 -dr 3 -ds 0.05 -dt 0.15 -lr 8 -lw 4e-07 -ss 1.0 -st 0.15 -w -g',
            '-ab 3 -aa 0.4 -ar 8 -ad 32 -as 16 -c 1 -dc 0.75 -dp 512 -dr 3 -ds 0.05 -dt 0.15 -lr 8 -lw 4e-07 -ss 1.0 -st 0.15 -w',
            '-ab 3 -aa 0.4 -ar 8 -ad 32 -as 16 -c 1 -dc 0.75 -dp 512 -dr 3 -ds 0.05 -dt 0.15 -lr 8 -lw 4e-07 -ss 1.0 -st 0.15 -w',
            '-ab 3 -aa 0.2 -ar 16 -ad 64 -as 32 -c 1 -dc 0.75 -dp 512 -dr 3 -ds 0.05 -dt 0.15 -lr 8 -lw 4e-07 -ss 1.0 -st 0.15 -w',
            '-ab 3 -aa 0.1 -ar 32 -ad 128 -as 64 -c 1 -dc 0.75 -dp 512 -dr 3 -ds 0.05 -dt 0.15 -lr 8 -lw 4e-07 -ss 1.0 -st 0.15 -w',
            '-ab 3 -aa 0.05 -ar 64 -ad 256 -as 128 -c 1 -dc 0.75 -dp 512 -dr 3 -ds 0.05 -dt 0.15 -lr 8 -lw 4e-07 -ss 1.0 -st 0.15 -w',
            '-ab 3 -aa 0 -ar 128 -ad 512 -as 256 -c 1 -dc 0.75 -dp 512 -dr 3 -ds 0.05 -dt 0.15 -lr 8 -lw 4e-07 -ss 1.0 -st 0.15 -w',
            '-ab 3 -aa 0 -ar 256 -ad 1024 -as 512 -c 1 -dc 0.75 -dp 512 -dr 3 -ds 0.05 -dt 0.15 -lr 8 -lw 4e-07 -ss 1.0 -st 0.15 -w',
            '-ab 3 -aa 0 -ar 512 -ad 2048 -as 1024 -c 1 -dc 0.75 -dp 512 -dr 3 -ds 0.05 -dt 0.15 -lr 8 -lw 4e-07 -ss 1.0 -st 0.15 -w',
            '-ab 3 -aa 0 -ar 1024 -ad 4096 -as 2048 -c 1 -dc 0.75 -dp 512 -dr 3 -ds 0.05 -dt 0.15 -lr 8 -lw 4e-07 -ss 1.0 -st 0.15 -w',
            '-ab 3 -aa 0 -ar 2048 -ad 8192 -as 4096 -c 1 -dc 0.75 -dp 512 -dr 3 -ds 0.05 -dt 0.15 -lr 8 -lw 4e-07 -ss 1.0 -st 0.15 -w',
            '-ab 4 -aa 0.4 -ar 8 -ad 32 -as 16 -c 1 -dc 0.75 -dp 512 -dr 3 -ds 0.05 -dt 0.15 -lr 8 -lw 4e-07 -ss 1.0 -st 0.15 -w',
            '-ab 4 -aa 0.2 -ar 16 -ad 64 -as 32 -c 1 -dc 0.75 -dp 512 -dr 3 -ds 0.05 -dt 0.15 -lr 8 -lw 4e-07 -ss 1.0 -st 0.15 -w',
            '-ab 4 -aa 0.1 -ar 32 -ad 128 -as 64 -c 1 -dc 0.75 -dp 512 -dr 3 -ds 0.05 -dt 0.15 -lr 8 -lw 4e-07 -ss 1.0 -st 0.15 -w',
            '-ab 4 -aa 0.05 -ar 64 -ad 256 -as 128 -c 1 -dc 0.75 -dp 512 -dr 3 -ds 0.05 -dt 0.15 -lr 8 -lw 4e-07 -ss 1.0 -st 0.15 -w',
            '-ab 4 -aa 0 -ar 128 -ad 512 -as 256 -c 1 -dc 0.75 -dp 512 -dr 3 -ds 0.05 -dt 0.15 -lr 8 -lw 4e-07 -ss 1.0 -st 0.15 -w',
            '-ab 4 -aa 0 -ar 256 -ad 1024 -as 512 -c 1 -dc 0.75 -dp 512 -dr 3 -ds 0.05 -dt 0.15 -lr 8 -lw 4e-07 -ss 1.0 -st 0.15 -w',
            '-ab 4 -aa 0 -ar 512 -ad 2048 -as 1024 -c 1 -dc 0.75 -dp 512 -dr 3 -ds 0.05 -dt 0.15 -lr 8 -lw 4e-07 -ss 1.0 -st 0.15 -w',
            '-ab 4 -aa 0 -ar 1024 -ad 4096 -as 2048 -c 1 -dc 0.75 -dp 512 -dr 3 -ds 0.05 -dt 0.15 -lr 8 -lw 4e-07 -ss 1.0 -st 0.15 -w',
            '-ab 4 -aa 0 -ar 2048 -ad 8192 -as 4096 -c 1 -dc 0.75 -dp 512 -dr 3 -ds 0.05 -dt 0.15 -lr 8 -lw 4e-07 -ss 1.0 -st 0.15 -w',
            '-ab 5 -aa 0.4 -ar 8 -ad 32 -as 16 -c 1 -dc 0.75 -dp 512 -dr 3 -ds 0.05 -dt 0.15 -lr 8 -lw 4e-07 -ss 1.0 -st 0.15 -w',
            '-ab 5 -aa 0.2 -ar 16 -ad 64 -as 32 -c 1 -dc 0.75 -dp 512 -dr 3 -ds 0.05 -dt 0.15 -lr 8 -lw 4e-07 -ss 1.0 -st 0.15 -w',
            '-ab 5 -aa 0.1 -ar 32 -ad 128 -as 64 -c 1 -dc 0.75 -dp 512 -dr 3 -ds 0.05 -dt 0.15 -lr 8 -lw 4e-07 -ss 1.0 -st 0.15 -w',
            '-ab 5 -aa 0.05 -ar 64 -ad 256 -as 128 -c 1 -dc 0.75 -dp 512 -dr 3 -ds 0.05 -dt 0.15 -lr 8 -lw 4e-07 -ss 1.0 -st 0.15 -w',
            '-ab 5 -aa 0 -ar 128 -ad 512 -as 256 -c 1 -dc 0.75 -dp 512 -dr 3 -ds 0.05 -dt 0.15 -lr 8 -lw 4e-07 -ss 1.0 -st 0.15 -w',
            '-ab 5 -aa 0 -ar 256 -ad 1024 -as 512 -c 1 -dc 0.75 -dp 512 -dr 3 -ds 0.05 -dt 0.15 -lr 8 -lw 4e-07 -ss 1.0 -st 0.15 -w',
            '-ab 5 -aa 0 -ar 512 -ad 2048 -as 1024 -c 1 -dc 0.75 -dp 512 -dr 3 -ds 0.05 -dt 0.15 -lr 8 -lw 4e-07 -ss 1.0 -st 0.15 -w',
            '-ab 5 -aa 0 -ar 1024 -ad 4096 -as 2048 -c 1 -dc 0.75 -dp 512 -dr 3 -ds 0.05 -dt 0.15 -lr 8 -lw 4e-07 -ss 1.0 -st 0.15 -w',
            '-ab 5 -aa 0 -ar 2048 -ad 8192 -as 4096 -c 1 -dc 0.75 -dp 512 -dr 3 -ds 0.05 -dt 0.15 -lr 8 -lw 4e-07 -ss 1.0 -st 0.15 -w',
            '-ab 7 -aa 0.4 -ar 8 -ad 32 -as 16 -c 1 -dc 0.75 -dp 512 -dr 3 -ds 0.05 -dt 0.15 -lr 8 -lw 4e-07 -ss 1.0 -st 0.15 -w',
            '-ab 7 -aa 0.2 -ar 16 -ad 64 -as 32 -c 1 -dc 0.75 -dp 512 -dr 3 -ds 0.05 -dt 0.15 -lr 8 -lw 4e-07 -ss 1.0 -st 0.15 -w',
            '-ab 7 -aa 0.1 -ar 32 -ad 128 -as 64 -c 1 -dc 0.75 -dp 512 -dr 3 -ds 0.05 -dt 0.15 -lr 8 -lw 4e-07 -ss 1.0 -st 0.15 -w',
            '-ab 7 -aa 0.05 -ar 64 -ad 256 -as 128 -c 1 -dc 0.75 -dp 512 -dr 3 -ds 0.05 -dt 0.15 -lr 8 -lw 4e-07 -ss 1.0 -st 0.15 -w',
            '-ab 7 -aa 0 -ar 128 -ad 512 -as 256 -c 1 -dc 0.75 -dp 512 -dr 3 -ds 0.05 -dt 0.15 -lr 8 -lw 4e-07 -ss 1.0 -st 0.15 -w',
            '-ab 7 -aa 0 -ar 256 -ad 1024 -as 512 -c 1 -dc 0.75 -dp 512 -dr 3 -ds 0.05 -dt 0.15 -lr 8 -lw 4e-07 -ss 1.0 -st 0.15 -w',
            '-ab 7 -aa 0 -ar 512 -ad 2048 -as 1024 -c 1 -dc 0.75 -dp 512 -dr 3 -ds 0.05 -dt 0.15 -lr 8 -lw 4e-07 -ss 1.0 -st 0.15 -w',
            '-ab 7 -aa 0 -ar 1024 -ad 4096 -as 2048 -c 1 -dc 0.75 -dp 512 -dr 3 -ds 0.05 -dt 0.15 -lr 8 -lw 4e-07 -ss 1.0 -st 0.15 -w',
            '-ab 7 -aa 0 -ar 2048 -ad 8192 -as 4096 -c 1 -dc 0.75 -dp 512 -dr 3 -ds 0.05 -dt 0.15 -lr 8 -lw 4e-07 -ss 1.0 -st 0.15 -w',
            '-ab 9 -aa 0.4 -ar 8 -ad 32 -as 16 -c 1 -dc 0.75 -dp 512 -dr 3 -ds 0.05 -dt 0.15 -lr 8 -lw 4e-07 -ss 1.0 -st 0.15 -w',
            '-ab 9 -aa 0.2 -ar 16 -ad 64 -as 32 -c 1 -dc 0.75 -dp 512 -dr 3 -ds 0.05 -dt 0.15 -lr 8 -lw 4e-07 -ss 1.0 -st 0.15 -w',
            '-ab 9 -aa 0.1 -ar 32 -ad 128 -as 64 -c 1 -dc 0.75 -dp 512 -dr 3 -ds 0.05 -dt 0.15 -lr 8 -lw 4e-07 -ss 1.0 -st 0.15 -w',
            '-ab 9 -aa 0.05 -ar 64 -ad 256 -as 128 -c 1 -dc 0.75 -dp 512 -dr 3 -ds 0.05 -dt 0.15 -lr 8 -lw 4e-07 -ss 1.0 -st 0.15 -w',
            '-ab 9 -aa 0 -ar 128 -ad 512 -as 256 -c 1 -dc 0.75 -dp 512 -dr 3 -ds 0.05 -dt 0.15 -lr 8 -lw 4e-07 -ss 1.0 -st 0.15 -w',
            '-ab 9 -aa 0 -ar 256 -ad 1024 -as 512 -c 1 -dc 0.75 -dp 512 -dr 3 -ds 0.05 -dt 0.15 -lr 8 -lw 4e-07 -ss 1.0 -st 0.15 -w',
            '-ab 9 -aa 0 -ar 512 -ad 2048 -as 1024 -c 1 -dc 0.75 -dp 512 -dr 3 -ds 0.05 -dt 0.15 -lr 8 -lw 4e-07 -ss 1.0 -st 0.15 -w',
            '-ab 9 -aa 0 -ar 1024 -ad 4096 -as 2048 -c 1 -dc 0.75 -dp 512 -dr 3 -ds 0.05 -dt 0.15 -lr 8 -lw 4e-07 -ss 1.0 -st 0.15 -w',
            '-ab 9 -aa 0 -ar 2048 -ad 8192 -as 4096 -c 1 -dc 0.75 -dp 512 -dr 3 -ds 0.05 -dt 0.15 -lr 8 -lw 4e-07 -ss 1.0 -st 0.15 -w',
            '-ab 11 -aa 0.4 -ar 8 -ad 32 -as 16 -c 1 -dc 0.75 -dp 512 -dr 3 -ds 0.05 -dt 0.15 -lr 8 -lw 4e-07 -ss 1.0 -st 0.15 -w',
            '-ab 11 -aa 0.2 -ar 16 -ad 64 -as 32 -c 1 -dc 0.75 -dp 512 -dr 3 -ds 0.05 -dt 0.15 -lr 8 -lw 4e-07 -ss 1.0 -st 0.15 -w',
            '-ab 11 -aa 0.1 -ar 32 -ad 128 -as 64 -c 1 -dc 0.75 -dp 512 -dr 3 -ds 0.05 -dt 0.15 -lr 8 -lw 4e-07 -ss 1.0 -st 0.15 -w',
            '-ab 11 -aa 0.05 -ar 64 -ad 256 -as 128 -c 1 -dc 0.75 -dp 512 -dr 3 -ds 0.05 -dt 0.15 -lr 8 -lw 4e-07 -ss 1.0 -st 0.15 -w',
            '-ab 11 -aa 0 -ar 128 -ad 512 -as 256 -c 1 -dc 0.75 -dp 512 -dr 3 -ds 0.05 -dt 0.15 -lr 8 -lw 4e-07 -ss 1.0 -st 0.15 -w',
            '-ab 11 -aa 0 -ar 256 -ad 1024 -as 512 -c 1 -dc 0.75 -dp 512 -dr 3 -ds 0.05 -dt 0.15 -lr 8 -lw 4e-07 -ss 1.0 -st 0.15 -w',
            '-ab 11 -aa 0 -ar 512 -ad 2048 -as 1024 -c 1 -dc 0.75 -dp 512 -dr 3 -ds 0.05 -dt 0.15 -lr 8 -lw 4e-07 -ss 1.0 -st 0.15 -w',
            '-ab 11 -aa 0 -ar 1024 -ad 4096 -as 2048 -c 1 -dc 0.75 -dp 512 -dr 3 -ds 0.05 -dt 0.15 -lr 8 -lw 4e-07 -ss 1.0 -st 0.15 -w',
            '-ab 11 -aa 0 -ar 2048 -ad 8192 -as 4096 -c 1 -dc 0.75 -dp 512 -dr 3 -ds 0.05 -dt 0.15 -lr 8 -lw 4e-07 -ss 1.0 -st 0.15 -w',
            '-ab 12 -aa 0.4 -ar 8 -ad 32 -as 16 -c 1 -dc 0.75 -dp 512 -dr 3 -ds 0.05 -dt 0.15 -lr 8 -lw 4e-07 -ss 1.0 -st 0.15 -w',
            '-ab 12 -aa 0.2 -ar 16 -ad 64 -as 32 -c 1 -dc 0.75 -dp 512 -dr 3 -ds 0.05 -dt 0.15 -lr 8 -lw 4e-07 -ss 1.0 -st 0.15 -w',
            '-ab 12 -aa 0.1 -ar 32 -ad 128 -as 64 -c 1 -dc 0.75 -dp 512 -dr 3 -ds 0.05 -dt 0.15 -lr 8 -lw 4e-07 -ss 1.0 -st 0.15 -w',
            '-ab 12 -aa 0.05 -ar 64 -ad 256 -as 128 -c 1 -dc 0.75 -dp 512 -dr 3 -ds 0.05 -dt 0.15 -lr 8 -lw 4e-07 -ss 1.0 -st 0.15 -w',
            '-ab 12 -aa 0 -ar 128 -ad 512 -as 256 -c 1 -dc 0.75 -dp 512 -dr 3 -ds 0.05 -dt 0.15 -lr 8 -lw 4e-07 -ss 1.0 -st 0.15 -w',
            '-ab 12 -aa 0 -ar 256 -ad 1024 -as 512 -c 1 -dc 0.75 -dp 512 -dr 3 -ds 0.05 -dt 0.15 -lr 8 -lw 4e-07 -ss 1.0 -st 0.15 -w',
            '-ab 12 -aa 0 -ar 512 -ad 2048 -as 1024 -c 1 -dc 0.75 -dp 512 -dr 3 -ds 0.05 -dt 0.15 -lr 8 -lw 4e-07 -ss 1.0 -st 0.15 -w',
            '-ab 12 -aa 0 -ar 1024 -ad 4096 -as 2048 -c 1 -dc 0.75 -dp 512 -dr 3 -ds 0.05 -dt 0.15 -lr 8 -lw 4e-07 -ss 1.0 -st 0.15 -w',
            '-ab 12 -aa 0 -ar 2048 -ad 8192 -as 4096 -c 1 -dc 0.75 -dp 512 -dr 3 -ds 0.05 -dt 0.15 -lr 8 -lw 4e-07 -ss 1.0 -st 0.1 -w'
            '-ab 3 -aa 0.4 -ar 8 -ad 32 -as 16 -c 1 -dc 0.75 -dp 512 -dr 3 -ds 0.05 -dt 0.15 -lr 8 -lw 4e-07 -ss 1.0 -st 0.15 -w -g',
            '-ab 3 -aa 0.4 -ar 8 -ad 32 -as 16 -c 1 -dc 0.75 -dp 512 -dr 3 -ds 0.05 -dt 0.15 -lr 8 -lw 4e-07 -ss 1.0 -st 0.15 -w -g',
            '-ab 3 -aa 0.2 -ar 16 -ad 64 -as 32 -c 1 -dc 0.75 -dp 512 -dr 3 -ds 0.05 -dt 0.15 -lr 8 -lw 4e-07 -ss 1.0 -st 0.15 -w -g',
            '-ab 3 -aa 0.1 -ar 32 -ad 128 -as 64 -c 1 -dc 0.75 -dp 512 -dr 3 -ds 0.05 -dt 0.15 -lr 8 -lw 4e-07 -ss 1.0 -st 0.15 -w -g',
            '-ab 3 -aa 0.05 -ar 64 -ad 256 -as 128 -c 1 -dc 0.75 -dp 512 -dr 3 -ds 0.05 -dt 0.15 -lr 8 -lw 4e-07 -ss 1.0 -st 0.15 -w -g',
            '-ab 3 -aa 0 -ar 128 -ad 512 -as 256 -c 1 -dc 0.75 -dp 512 -dr 3 -ds 0.05 -dt 0.15 -lr 8 -lw 4e-07 -ss 1.0 -st 0.15 -w -g',
            '-ab 3 -aa 0 -ar 256 -ad 1024 -as 512 -c 1 -dc 0.75 -dp 512 -dr 3 -ds 0.05 -dt 0.15 -lr 8 -lw 4e-07 -ss 1.0 -st 0.15 -w -g',
            '-ab 3 -aa 0 -ar 512 -ad 2048 -as 1024 -c 1 -dc 0.75 -dp 512 -dr 3 -ds 0.05 -dt 0.15 -lr 8 -lw 4e-07 -ss 1.0 -st 0.15 -w -g',
            '-ab 3 -aa 0 -ar 1024 -ad 4096 -as 2048 -c 1 -dc 0.75 -dp 512 -dr 3 -ds 0.05 -dt 0.15 -lr 8 -lw 4e-07 -ss 1.0 -st 0.15 -w -g',
            '-ab 3 -aa 0 -ar 2048 -ad 8192 -as 4096 -c 1 -dc 0.75 -dp 512 -dr 3 -ds 0.05 -dt 0.15 -lr 8 -lw 4e-07 -ss 1.0 -st 0.15 -w -g',
            '-ab 4 -aa 0.4 -ar 8 -ad 32 -as 16 -c 1 -dc 0.75 -dp 512 -dr 3 -ds 0.05 -dt 0.15 -lr 8 -lw 4e-07 -ss 1.0 -st 0.15 -w -g',
            '-ab 4 -aa 0.2 -ar 16 -ad 64 -as 32 -c 1 -dc 0.75 -dp 512 -dr 3 -ds 0.05 -dt 0.15 -lr 8 -lw 4e-07 -ss 1.0 -st 0.15 -w -g',
            '-ab 4 -aa 0.1 -ar 32 -ad 128 -as 64 -c 1 -dc 0.75 -dp 512 -dr 3 -ds 0.05 -dt 0.15 -lr 8 -lw 4e-07 -ss 1.0 -st 0.15 -w -g',
            '-ab 4 -aa 0.05 -ar 64 -ad 256 -as 128 -c 1 -dc 0.75 -dp 512 -dr 3 -ds 0.05 -dt 0.15 -lr 8 -lw 4e-07 -ss 1.0 -st 0.15 -w -g',
            '-ab 4 -aa 0 -ar 128 -ad 512 -as 256 -c 1 -dc 0.75 -dp 512 -dr 3 -ds 0.05 -dt 0.15 -lr 8 -lw 4e-07 -ss 1.0 -st 0.15 -w -g',
            '-ab 4 -aa 0 -ar 256 -ad 1024 -as 512 -c 1 -dc 0.75 -dp 512 -dr 3 -ds 0.05 -dt 0.15 -lr 8 -lw 4e-07 -ss 1.0 -st 0.15 -w -g',
            '-ab 4 -aa 0 -ar 512 -ad 2048 -as 1024 -c 1 -dc 0.75 -dp 512 -dr 3 -ds 0.05 -dt 0.15 -lr 8 -lw 4e-07 -ss 1.0 -st 0.15 -w -g',
            '-ab 4 -aa 0 -ar 1024 -ad 4096 -as 2048 -c 1 -dc 0.75 -dp 512 -dr 3 -ds 0.05 -dt 0.15 -lr 8 -lw 4e-07 -ss 1.0 -st 0.15 -w -g',
            '-ab 4 -aa 0 -ar 2048 -ad 8192 -as 4096 -c 1 -dc 0.75 -dp 512 -dr 3 -ds 0.05 -dt 0.15 -lr 8 -lw 4e-07 -ss 1.0 -st 0.15 -w -g',
            '-ab 5 -aa 0.4 -ar 8 -ad 32 -as 16 -c 1 -dc 0.75 -dp 512 -dr 3 -ds 0.05 -dt 0.15 -lr 8 -lw 4e-07 -ss 1.0 -st 0.15 -w -g',
            '-ab 5 -aa 0.2 -ar 16 -ad 64 -as 32 -c 1 -dc 0.75 -dp 512 -dr 3 -ds 0.05 -dt 0.15 -lr 8 -lw 4e-07 -ss 1.0 -st 0.15 -w -g',
            '-ab 5 -aa 0.1 -ar 32 -ad 128 -as 64 -c 1 -dc 0.75 -dp 512 -dr 3 -ds 0.05 -dt 0.15 -lr 8 -lw 4e-07 -ss 1.0 -st 0.15 -w -g',
            '-ab 5 -aa 0.05 -ar 64 -ad 256 -as 128 -c 1 -dc 0.75 -dp 512 -dr 3 -ds 0.05 -dt 0.15 -lr 8 -lw 4e-07 -ss 1.0 -st 0.15 -w -g',
            '-ab 5 -aa 0 -ar 128 -ad 512 -as 256 -c 1 -dc 0.75 -dp 512 -dr 3 -ds 0.05 -dt 0.15 -lr 8 -lw 4e-07 -ss 1.0 -st 0.15 -w -g',
            '-ab 5 -aa 0 -ar 256 -ad 1024 -as 512 -c 1 -dc 0.75 -dp 512 -dr 3 -ds 0.05 -dt 0.15 -lr 8 -lw 4e-07 -ss 1.0 -st 0.15 -w -g',
            '-ab 5 -aa 0 -ar 512 -ad 2048 -as 1024 -c 1 -dc 0.75 -dp 512 -dr 3 -ds 0.05 -dt 0.15 -lr 8 -lw 4e-07 -ss 1.0 -st 0.15 -w -g',
            '-ab 5 -aa 0 -ar 1024 -ad 4096 -as 2048 -c 1 -dc 0.75 -dp 512 -dr 3 -ds 0.05 -dt 0.15 -lr 8 -lw 4e-07 -ss 1.0 -st 0.15 -w -g',
            '-ab 5 -aa 0 -ar 2048 -ad 8192 -as 4096 -c 1 -dc 0.75 -dp 512 -dr 3 -ds 0.05 -dt 0.15 -lr 8 -lw 4e-07 -ss 1.0 -st 0.15 -w -g',
            '-ab 7 -aa 0.4 -ar 8 -ad 32 -as 16 -c 1 -dc 0.75 -dp 512 -dr 3 -ds 0.05 -dt 0.15 -lr 8 -lw 4e-07 -ss 1.0 -st 0.15 -w -g',
            '-ab 7 -aa 0.2 -ar 16 -ad 64 -as 32 -c 1 -dc 0.75 -dp 512 -dr 3 -ds 0.05 -dt 0.15 -lr 8 -lw 4e-07 -ss 1.0 -st 0.15 -w -g',
            '-ab 7 -aa 0.1 -ar 32 -ad 128 -as 64 -c 1 -dc 0.75 -dp 512 -dr 3 -ds 0.05 -dt 0.15 -lr 8 -lw 4e-07 -ss 1.0 -st 0.15 -w -g',
            '-ab 7 -aa 0.05 -ar 64 -ad 256 -as 128 -c 1 -dc 0.75 -dp 512 -dr 3 -ds 0.05 -dt 0.15 -lr 8 -lw 4e-07 -ss 1.0 -st 0.15 -w -g',
            '-ab 7 -aa 0 -ar 128 -ad 512 -as 256 -c 1 -dc 0.75 -dp 512 -dr 3 -ds 0.05 -dt 0.15 -lr 8 -lw 4e-07 -ss 1.0 -st 0.15 -w -g',
            '-ab 7 -aa 0 -ar 256 -ad 1024 -as 512 -c 1 -dc 0.75 -dp 512 -dr 3 -ds 0.05 -dt 0.15 -lr 8 -lw 4e-07 -ss 1.0 -st 0.15 -w -g',
            '-ab 7 -aa 0 -ar 512 -ad 2048 -as 1024 -c 1 -dc 0.75 -dp 512 -dr 3 -ds 0.05 -dt 0.15 -lr 8 -lw 4e-07 -ss 1.0 -st 0.15 -w -g',
            '-ab 7 -aa 0 -ar 1024 -ad 4096 -as 2048 -c 1 -dc 0.75 -dp 512 -dr 3 -ds 0.05 -dt 0.15 -lr 8 -lw 4e-07 -ss 1.0 -st 0.15 -w -g',
            '-ab 7 -aa 0 -ar 2048 -ad 8192 -as 4096 -c 1 -dc 0.75 -dp 512 -dr 3 -ds 0.05 -dt 0.15 -lr 8 -lw 4e-07 -ss 1.0 -st 0.15 -w -g',
            '-ab 9 -aa 0.4 -ar 8 -ad 32 -as 16 -c 1 -dc 0.75 -dp 512 -dr 3 -ds 0.05 -dt 0.15 -lr 8 -lw 4e-07 -ss 1.0 -st 0.15 -w -g',
            '-ab 9 -aa 0.2 -ar 16 -ad 64 -as 32 -c 1 -dc 0.75 -dp 512 -dr 3 -ds 0.05 -dt 0.15 -lr 8 -lw 4e-07 -ss 1.0 -st 0.15 -w -g',
            '-ab 9 -aa 0.1 -ar 32 -ad 128 -as 64 -c 1 -dc 0.75 -dp 512 -dr 3 -ds 0.05 -dt 0.15 -lr 8 -lw 4e-07 -ss 1.0 -st 0.15 -w -g',
            '-ab 9 -aa 0.05 -ar 64 -ad 256 -as 128 -c 1 -dc 0.75 -dp 512 -dr 3 -ds 0.05 -dt 0.15 -lr 8 -lw 4e-07 -ss 1.0 -st 0.15 -w -g',
            '-ab 9 -aa 0 -ar 128 -ad 512 -as 256 -c 1 -dc 0.75 -dp 512 -dr 3 -ds 0.05 -dt 0.15 -lr 8 -lw 4e-07 -ss 1.0 -st 0.15 -w -g',
            '-ab 9 -aa 0 -ar 256 -ad 1024 -as 512 -c 1 -dc 0.75 -dp 512 -dr 3 -ds 0.05 -dt 0.15 -lr 8 -lw 4e-07 -ss 1.0 -st 0.15 -w -g',
            '-ab 9 -aa 0 -ar 512 -ad 2048 -as 1024 -c 1 -dc 0.75 -dp 512 -dr 3 -ds 0.05 -dt 0.15 -lr 8 -lw 4e-07 -ss 1.0 -st 0.15 -w -g',
            '-ab 9 -aa 0 -ar 1024 -ad 4096 -as 2048 -c 1 -dc 0.75 -dp 512 -dr 3 -ds 0.05 -dt 0.15 -lr 8 -lw 4e-07 -ss 1.0 -st 0.15 -w -g',
            '-ab 9 -aa 0 -ar 2048 -ad 8192 -as 4096 -c 1 -dc 0.75 -dp 512 -dr 3 -ds 0.05 -dt 0.15 -lr 8 -lw 4e-07 -ss 1.0 -st 0.15 -w -g',
            '-ab 11 -aa 0.4 -ar 8 -ad 32 -as 16 -c 1 -dc 0.75 -dp 512 -dr 3 -ds 0.05 -dt 0.15 -lr 8 -lw 4e-07 -ss 1.0 -st 0.15 -w -g',
            '-ab 11 -aa 0.2 -ar 16 -ad 64 -as 32 -c 1 -dc 0.75 -dp 512 -dr 3 -ds 0.05 -dt 0.15 -lr 8 -lw 4e-07 -ss 1.0 -st 0.15 -w -g',
            '-ab 11 -aa 0.1 -ar 32 -ad 128 -as 64 -c 1 -dc 0.75 -dp 512 -dr 3 -ds 0.05 -dt 0.15 -lr 8 -lw 4e-07 -ss 1.0 -st 0.15 -w -g',
            '-ab 11 -aa 0.05 -ar 64 -ad 256 -as 128 -c 1 -dc 0.75 -dp 512 -dr 3 -ds 0.05 -dt 0.15 -lr 8 -lw 4e-07 -ss 1.0 -st 0.15 -w -g',
            '-ab 11 -aa 0 -ar 128 -ad 512 -as 256 -c 1 -dc 0.75 -dp 512 -dr 3 -ds 0.05 -dt 0.15 -lr 8 -lw 4e-07 -ss 1.0 -st 0.15 -w -g',
            '-ab 11 -aa 0 -ar 256 -ad 1024 -as 512 -c 1 -dc 0.75 -dp 512 -dr 3 -ds 0.05 -dt 0.15 -lr 8 -lw 4e-07 -ss 1.0 -st 0.15 -w -g',
            '-ab 11 -aa 0 -ar 512 -ad 2048 -as 1024 -c 1 -dc 0.75 -dp 512 -dr 3 -ds 0.05 -dt 0.15 -lr 8 -lw 4e-07 -ss 1.0 -st 0.15 -w -g',
            '-ab 11 -aa 0 -ar 1024 -ad 4096 -as 2048 -c 1 -dc 0.75 -dp 512 -dr 3 -ds 0.05 -dt 0.15 -lr 8 -lw 4e-07 -ss 1.0 -st 0.15 -w -g',
            '-ab 11 -aa 0 -ar 2048 -ad 8192 -as 4096 -c 1 -dc 0.75 -dp 512 -dr 3 -ds 0.05 -dt 0.15 -lr 8 -lw 4e-07 -ss 1.0 -st 0.15 -w -g',
            '-ab 12 -aa 0.4 -ar 8 -ad 32 -as 16 -c 1 -dc 0.75 -dp 512 -dr 3 -ds 0.05 -dt 0.15 -lr 8 -lw 4e-07 -ss 1.0 -st 0.15 -w -g',
            '-ab 12 -aa 0.2 -ar 16 -ad 64 -as 32 -c 1 -dc 0.75 -dp 512 -dr 3 -ds 0.05 -dt 0.15 -lr 8 -lw 4e-07 -ss 1.0 -st 0.15 -w -g',
            '-ab 12 -aa 0.1 -ar 32 -ad 128 -as 64 -c 1 -dc 0.75 -dp 512 -dr 3 -ds 0.05 -dt 0.15 -lr 8 -lw 4e-07 -ss 1.0 -st 0.15 -w -g',
            '-ab 12 -aa 0.05 -ar 64 -ad 256 -as 128 -c 1 -dc 0.75 -dp 512 -dr 3 -ds 0.05 -dt 0.15 -lr 8 -lw 4e-07 -ss 1.0 -st 0.15 -w -g',
            '-ab 12 -aa 0 -ar 128 -ad 512 -as 256 -c 1 -dc 0.75 -dp 512 -dr 3 -ds 0.05 -dt 0.15 -lr 8 -lw 4e-07 -ss 1.0 -st 0.15 -w -g',
            '-ab 12 -aa 0 -ar 256 -ad 1024 -as 512 -c 1 -dc 0.75 -dp 512 -dr 3 -ds 0.05 -dt 0.15 -lr 8 -lw 4e-07 -ss 1.0 -st 0.15 -w -g',
            '-ab 12 -aa 0 -ar 512 -ad 2048 -as 1024 -c 1 -dc 0.75 -dp 512 -dr 3 -ds 0.05 -dt 0.15 -lr 8 -lw 4e-07 -ss 1.0 -st 0.15 -w -g',
            '-ab 12 -aa 0 -ar 1024 -ad 4096 -as 2048 -c 1 -dc 0.75 -dp 512 -dr 3 -ds 0.05 -dt 0.15 -lr 8 -lw 4e-07 -ss 1.0 -st 0.15 -w -g',
            '-ab 12 -aa 0 -ar 2048 -ad 8192 -as 4096 -c 1 -dc 0.75 -dp 512 -dr 3 -ds 0.05 -dt 0.15 -lr 8 -lw 4e-07 -ss 1.0 -st 0.15 -w -g'
            ]

selected_params = arguments[idx]
base_params = arguments[base_idx]
# ---------- end ghpython_script_7 ----------
list_item_9 = ListItem(List=sort_list_4.Keys, Index=0, Wrap=True)
base_time = Panel(ghpython_script_5.base_time)  # disabled
selected_time = Panel(ghpython_script_5.selected_time)  # disabled

clean_tree = CleanTree(RemoveNulls=True, RemoveInvalid=True, RemoveEmpty=False, Tree=ghpython_script_6.points)  # disabled
number_slider_5 = Slider(100, range=0..1000)  # disabled
remap_numbers_2 = RemapNumbers(Value=ghpython_script_5.selected_values, Source=Domain(0, 1000), Target=Domain(0, 1))  # -> Mapped, Clipped; disabled
gradient_2 = Gradient(
    LowerLimit=0,
    UpperLimit=1,
    Parameter=remap_numbers_2.Mapped,
    stops=[0: RGB(0, 0, 0), 0.249: RGB(173, 203, 249), 0.5: RGB(254, 244, 84), 0.746: RGB(234, 126, 0), 1: RGB(234, 38, 0)])  # disabled
unit_x = UnitX(Factor=number_slider_5)  # disabled
unit_y = UnitY(Factor=number_slider_5)  # disabled
addition = Addition(A=unit_x, B=unit_y)  # disabled
symbol_simple_2 = SymbolSimple(Style=5, Size=3, Rotation=0, Colour=gradient_2)  # disabled
# Selected Irradiance
move_3 = Move(Geometry=clean_tree, Motion=addition)  # -> Geometry, Transform; disabled
symbol_display_2 = SymbolDisplay(Location=move_3.Geometry, Display=symbol_simple_2)  # disabled

clean_tree_2 = CleanTree(RemoveNulls=True, RemoveInvalid=True, RemoveEmpty=False, Tree=ghpython_script_6.points)  # disabled
remap_numbers_3 = RemapNumbers(Value=ghpython_script_5.base_values, Source=Domain(0, 1000), Target=Domain(0, 1))  # -> Mapped, Clipped; disabled
gradient_3 = Gradient(
    LowerLimit=0,
    UpperLimit=1,
    Parameter=remap_numbers_3.Mapped,
    stops=[0: RGB(0, 0, 0), 0.249: RGB(173, 203, 249), 0.5: RGB(254, 244, 84), 0.746: RGB(234, 126, 0), 1: RGB(234, 38, 0)])  # disabled
unit_x_2 = UnitX(Factor=expr("-x", number_slider_5))  # disabled
unit_y_2 = UnitY(Factor=expr("-x", number_slider_5))  # disabled
addition_2 = Addition(A=unit_x_2, B=unit_y_2)  # disabled
symbol_simple_3 = SymbolSimple(Style=5, Size=3, Rotation=0, Colour=gradient_3)  # disabled
# Base Irradiance
move_4 = Move(Geometry=clean_tree_2, Motion=addition_2)  # -> Geometry, Transform; disabled
symbol_display_3 = SymbolDisplay(Location=move_4.Geometry, Display=symbol_simple_3)  # disabled

base_params = Panel(ghpython_script_7.base_params)  # disabled
selected_params = Panel(ghpython_script_7.selected_params)  # disabled

subtraction_2 = Subtraction(A=ghpython_script_5.base_values, B=ghpython_script_5.selected_values)  # disabled
construct_domain = ConstructDomain(DomainStart=-100, DomainEnd=100)  # disabled
bounds = Bounds(Numbers=subtraction_2)  # disabled
remap_numbers_4 = RemapNumbers(Value=subtraction_2, Source=construct_domain, Target=Domain(0, 1))  # -> Mapped, Clipped; disabled
gradient_4 = Gradient(
    LowerLimit=0,
    UpperLimit=1,
    Parameter=remap_numbers_4.Clipped,
    stops=[0: RGB(0, 0, 255), 0.399: RGB(192, 192, 255), 0.5: RGB(255, 255, 255), 0.609: RGB(255, 192, 192), 1: RGB(255, 0, 0)])  # disabled
symbol_simple_4 = SymbolSimple(Style=5, Size=3, Rotation=0, Colour=gradient_4)  # disabled
# Error
symbol_display_4 = SymbolDisplay(Location=clean_tree, Display=symbol_simple_4)  # disabled

point_2 = Point(Point(47, 150, 0))  # disabled
point_3 = Point(Point(-152, -49, 0))  # disabled
point_4 = Point(Point(-54, 53, 0))  # disabled
text_tag = TextTag(Location=point_2, Text="'Selected'", Colour=RGB(0, 0, 0))  # disabled
text_tag_2 = TextTag(Location=point_3, Text="'Base'", Colour=RGB(0, 0, 0))  # disabled
text_tag_3 = TextTag(Location=point_4, Text=selected_params, Colour=RGB(0, 0, 0))  # disabled
